# Grasshopper definition 04thermalcomfort.gh (Grasshopper 1.0.7)
# plug-ins: Bifocals, Human

# ----
# 选择基础房间功能属性
bldgprograms = HBBuildingPrograms({"LargeOffice", "MediumOffice", "SmallOffice", "MidriseApartment", "HighriseApartment", "Retail", "StripMall", "PrimarySchool", "SecondarySchool", "SmallHotel", "LargeHotel", "Hospital", "Outpatient", "Laboratory", "Warehouse", "SuperMarket", "FullServiceRestaurant", "QuickServiceRestaurant", "Courthouse", "LargeDataCenterHighITE", "LargeDataCenterLowITE", "SmallDataCenterHighITE", "SmallDataCenterLowITE"}, selected="SmallOffice")
bldgvintages = HBBuildingVintages({"ASHRAE 90.1 2019  |  IECC 2021": "2019", "ASHRAE 90.1 2016  |  IECC 2018": "2016", "ASHRAE 90.1 2013  |  IECC 2015": "2013", "ASHRAE 90.1 2010  |  IECC 2012": "2010", "ASHRAE 90.1 2007  |  IECC 2009": "2007", "ASHRAE 90.1 2004  |  IECC 2006": "2004", "1980-2004 (CBECS)": "1980_2004", "Pre-1980 (CBECS)": "pre_1980"}, selected="ASHRAE 90.1 2019  |  IECC 2021")
searchprog = HBSearchPrograms(bldg_prog=bldgprograms, vintage=bldgvintages)  # -> room_prog; plug-in component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
list = ItemSelector(
    searchprog,
    {"2019::SmallOffice::Breakroom", "2019::SmallOffice::Classroom", "2019::SmallOffice::ClosedOffice", "2019::SmallOffice::Conference", "2019::SmallOffice::Corridor", "2019::SmallOffice::Dining", "2019::SmallOffice::Elec/MechRoom", "2019::SmallOffice::Lobby", "2019::SmallOffice::OpenOffice", "2019::SmallOffice::Restroom", "2019::SmallOffice::Stair", "2019::SmallOffice::Storage"}, selected="2019::SmallOffice::ClosedOffice")

# ----
# 前期设定
# 选择基础房间功能属性
bldgprograms_2 = HBBuildingPrograms({"LargeOffice", "MediumOffice", "SmallOffice", "MidriseApartment", "HighriseApartment", "Retail", "StripMall", "PrimarySchool", "SecondarySchool", "SmallHotel", "LargeHotel", "Hospital", "Outpatient", "Laboratory", "Warehouse", "SuperMarket", "FullServiceRestaurant", "QuickServiceRestaurant", "Courthouse", "LargeDataCenterHighITE", "LargeDataCenterLowITE", "SmallDataCenterHighITE", "SmallDataCenterLowITE"}, selected="MediumOffice")
bldgvintages_2 = HBBuildingVintages({"ASHRAE 90.1 2019  |  IECC 2021": "2019", "ASHRAE 90.1 2016  |  IECC 2018": "2016", "ASHRAE 90.1 2013  |  IECC 2015": "2013", "ASHRAE 90.1 2010  |  IECC 2012": "2010", "ASHRAE 90.1 2007  |  IECC 2009": "2007", "ASHRAE 90.1 2004  |  IECC 2006": "2004", "1980-2004 (CBECS)": "1980_2004", "Pre-1980 (CBECS)": "pre_1980"}, selected="ASHRAE 90.1 2019  |  IECC 2021")
searchprog_2 = HBSearchPrograms(bldg_prog=bldgprograms_2, vintage=bldgvintages_2)  # -> room_prog; plug-in component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
list_2 = ItemSelector(
    searchprog_2,
    {"2019::MediumOffice::Breakroom", "2019::MediumOffice::Classroom", "2019::MediumOffice::ClosedOffice", "2019::MediumOffice::Conference", "2019::MediumOffice::Corridor", "2019::MediumOffice::Dining", "2019::MediumOffice::Elec/MechRoom", "2019::MediumOffice::Lobby", "2019::MediumOffice::OpenOffice", "2019::MediumOffice::Restroom", "2019::MediumOffice::Stair", "2019::MediumOffice::Storage"}, selected="2019::MediumOffice::Conference")

# ----
# 选IWEC版本的stat文件
# 显示四季典型周等
path = FilePath("D:\15 cubicCRDM\Climatedata\shanghai\CHN_Shanghai.Shanghai.583670_IWEC.stat")
importstat = LBImportSTAT(stat_file=path)  # -> location, ashrae_zone, koppen_zone, clear_dir_norm_rad, clear_diff_horiz_rad, ann_heat_dday_996, ann_heat_dday_990, ann_cool_dday_004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; plug-in component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
panel = Panel(importstat.typical_weeks)

analysisperiod = LBAnalysisPeriod(start_month="1", start_day="1", start_hour=0, end_month="6", end_day="2")  # -> period, hoys, dates; plug-in component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
simpar = HBSimulationParameter(run_period=analysisperiod.period, timestep=6, terrain="Country")  # -> sim_par; plug-in component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

geo = Geometry([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])
geo_2 = Geometry(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)
shade = HBShade(geo=geo)  # -> report, shades; plug-in component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
roomsolid = HBRoomFromSolid(geo=flatten(geo_2), conditioned=True)  # -> report, rooms; plug-in component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
model = HBModel(rooms=flatten(roomsolid.rooms), shades=flatten(shade.shades))  # -> report, model; plug-in component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
vizwiref = HBVisualizeWireframe(hb_objs=flatten(model.model))  # -> geo; plug-in component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

evaluation_surface = Brep(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)
genpts = LBGeneratePointGrid(geometry=evaluation_surface, grid_size="0.5")  # -> points, vectors, face_areas, graft(mesh); plug-in component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
sensorgrid = HBSensorGrid(positions=genpts.points, directions=genpts.vectors)  # -> grid; plug-in component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
assigngridsviews = HBAssignGridsAndViews(model=model.model, grids=flatten(sensorgrid))  # -> model; plug-in component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

# ----
# 中空玻璃窗
panel_2 = Panel("Glass")
searchmats = HBSearchMaterials(keywords=panel_2)  # -> opaque_mats, window_mats; plug-in component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
searchmats_2 = HBSearchMaterials(keywords="mm")  # -> opaque_mats, window_mats; plug-in component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
searchmats_3 = HBSearchMaterials(keywords=panel_2)  # -> opaque_mats, window_mats; plug-in component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
list_3 = ItemSelector(
    searchmats_2.window_mats,
    {"AIR 13MM", "AIR 3MM", "AIR 6MM", "ARGON 13MM", "BLUE 6MM", "BRONZE 6MM", "CLEAR 2.5MM", "CLEAR 3MM", "CLEAR 6MM", "Clear 3mm"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}, selected="AIR 13MM")
list_4 = ItemSelector(
    searchmats.window_mats,
    {"Generic Clear Glass", "Generic Low-e Glass", "Glass_2010F_LayerAvg", "Glass_2022F_LayerAvg", "Glass_2027F_LayerAvg", "Glass_2052_LayerAvg", "Glass_2175_LayerAvg", "Theoretical Glass 297", "Theoretical Glass 347", "Theoretical Glass [167]", "Theoretical Glass [197]", "Theoretical Glass [202]", "Theoretical Glass [207]", "Theoretical Glass [216]", "Theoretical Glass [221]"}, selected="Generic Low-e Glass")
list_5 = ItemSelector(
    searchmats_3.window_mats,
    {"Generic Clear Glass", "Generic Low-e Glass", "Glass_2010F_LayerAvg", "Glass_2022F_LayerAvg", "Glass_2027F_LayerAvg", "Glass_2052_LayerAvg", "Glass_2175_LayerAvg", "Theoretical Glass 297", "Theoretical Glass 347", "Theoretical Glass [167]", "Theoretical Glass [197]", "Theoretical Glass [202]", "Theoretical Glass [207]", "Theoretical Glass [216]", "Theoretical Glass [221]"}, selected="Theoretical Glass 347")
merge = Merge(Data1=list_4, Data2=list_3, Data3=list_5)

# ----
# 选择房间构造属性
panel_3 = Panel("2019::ClimateZone3")
searchconstrset = HBSearchConstructionSets(keywords=panel_3)  # -> constr_sets; plug-in component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
list_6 = ItemSelector(
    searchconstrset,
    {"2019::ClimateZone3::Mass", "2019::ClimateZone3::Metal Building", "2019::ClimateZone3::SteelFramed", "2019::ClimateZone3::WoodFramed"}, selected="2019::ClimateZone3::Mass")

panel_4 = Panel(searchmats.window_mats)

# ---- group: Gene Pool
dayschedule = HBDaySchedule(
    Decimals=2,
    Maximum=1,
    Minimum=0,
    Value=[0, 0, 0, 0, 0, 0, 0, 0.2, 0.5, 0.8, 0.8, 0.8, 0.8, 0.8, 0.8, 0.8, 0.8, 0.8, 0.8, 0.7, 0.5, 0, 0, 0])

dayschedule_2 = HBDaySchedule(
    Decimals=2,
    Maximum=1,
    Minimum=0,
    Value=[0, 0, 0, 0, 0, 0, 0, 0.2, 0.5, 0.8, 0.8, 0.8, 0.8, 0.8, 0.8, 0.8, 0.8, 0.8, 0.8, 0.7, 0.5, 0, 0, 0])

# ----
# 解析时间表
deconstrprogram = HBDeconstructProgramType(program=list)  # -> people, lighting, electric_equip, gas_equip, hot_water, infiltration, ventilation, setpoint; plug-in component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
decnstrsetpoint = HBDeconstructSetpoint(setpoint=deconstrprogram.setpoint)  # -> name, heating_sch, cooling_sch, humid_setpt, dehumid_setpt; plug-in component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
decnstrpeople = HBDeconstructPeople(people=deconstrprogram.people)  # -> name, ppl_per_area, occupancy_sch, activity_sch; plug-in component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
deconstrsch = HBDeconstructSchedule(schedule=decnstrpeople.occupancy_sch)  # -> day_names, day_data, type_limit; plug-in component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
deconstrsch_2 = HBDeconstructSchedule(schedule=decnstrsetpoint.cooling_sch)  # -> day_names, day_data, type_limit; plug-in component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
number_slider = Slider(10, range=0..100)
panel_5 = Panel(decnstrsetpoint.humid_setpt)
hourlyplot = LBHourlyPlot(data=deconstrsch.day_data, x_dim=number_slider)  # -> report, mesh, legend, borders, labels, title; plug-in component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
hourlyplot_2 = LBHourlyPlot(data=deconstrsch_2.day_data, x_dim=number_slider)  # -> report, mesh, legend, borders, labels, title; plug-in component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

# ----
# 解析时间表
deconstrprogram_2 = HBDeconstructProgramType(program=list_2)  # -> people, lighting, electric_equip, gas_equip, hot_water, infiltration, ventilation, setpoint; plug-in component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
decnstrsetpoint_2 = HBDeconstructSetpoint(setpoint=deconstrprogram_2.setpoint)  # -> name, heating_sch, cooling_sch, humid_setpt, dehumid_setpt; plug-in component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
decnstrpeople_2 = HBDeconstructPeople(people=deconstrprogram_2.people)  # -> name, ppl_per_area, occupancy_sch, activity_sch; plug-in component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
deconstrsch_3 = HBDeconstructSchedule(schedule=decnstrsetpoint_2.cooling_sch)  # -> day_names, day_data, type_limit; plug-in component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
panel_6 = Panel(decnstrsetpoint_2.humid_setpt)
deconstrsch_4 = HBDeconstructSchedule(schedule=decnstrpeople_2.occupancy_sch)  # -> day_names, day_data, type_limit; plug-in component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
number_slider_2 = Slider(10, range=0..100)
hourlyplot_3 = LBHourlyPlot(data=deconstrsch_3.day_data, x_dim=number_slider_2)  # -> report, mesh, legend, borders, labels, title; plug-in component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
hourlyplot_4 = LBHourlyPlot(data=deconstrsch_4.day_data, x_dim=number_slider_2)  # -> report, mesh, legend, borders, labels, title; plug-in component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

# ----
# 每平方米人数
# 可以使用所选方案中
# 解析出来的值，也可
# 以根据设计自行更改
panel_7 = Panel(decnstrpeople.ppl_per_area)

# ----
# 每平方米人数
# 可以使用所选方案中
# 解析出来的值，也可
# 以根据设计自行更改
panel_8 = Panel(decnstrpeople_2.ppl_per_area)

# ----
# 室外热舒适的计算
# 建模
# 模拟结果可视化
# 划分网格
# 选定计算时段
boolean_toggle = BooleanToggle(True)
path_2 = FilePath("D:\15 cubicCRDM\Climatedata\shanghai\CHN_Shanghai.Shanghai.583670_IWEC.epw")
utcimap = HBUTCIComfortMap(model=assigngridsviews, epw=path_2, run_period=analysisperiod.period, run=boolean_toggle)  # -> report, env_conds, utci, condition, category, TCP, HSP, CSP; plug-in component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

panel_9 = Panel(deconstrsch_4.day_names)

# ----
# 修改制冷制热温度等
genes = GenePool(
    Decimals=0,
    Maximum=40,
    Minimum=0,
    Value=[40, 40, 40, 40, 40, 40, 40, 30, 28, 26, 26, 26, 26, 26, 26, 26, 26, 26, 26, 28, 30, 40, 40, 40])
genes_2 = GenePool(
    Decimals=0,
    Maximum=30,
    Minimum=0,
    Value=[10, 10, 10, 10, 10, 10, 10, 16, 17, 18, 18, 18, 18, 18, 18, 18, 18, 18, 18, 17, 16, 10, 10, 10])
constantschedule = HBConstantSchedule(values=genes, type_limit="Temperature")  # -> report, schedule, idf_text; plug-in component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
constantschedule_2 = HBConstantSchedule(values=genes_2, type_limit="Temperature")  # -> report, schedule, idf_text; plug-in component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
setpoint = HBSetpoint(heating_sch=constantschedule_2.schedule, cooling_sch=constantschedule.schedule)  # -> setpoint; plug-in component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

# ----
# 修改制冷制热温度等
genes_3 = GenePool(
    Decimals=0,
    Maximum=40,
    Minimum=0,
    Value=[40, 40, 40, 40, 40, 40, 40, 30, 28, 26, 26, 26, 26, 26, 26, 26, 26, 26, 26, 28, 30, 40, 40, 40])
genes_4 = GenePool(
    Decimals=0,
    Maximum=30,
    Minimum=0,
    Value=[10, 10, 10, 10, 10, 10, 10, 16, 17, 18, 18, 18, 18, 18, 18, 18, 18, 18, 18, 17, 16, 10, 10, 10])
constantschedule_3 = HBConstantSchedule(values=genes_3, type_limit="Temperature")  # -> report, schedule, idf_text; plug-in component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
constantschedule_4 = HBConstantSchedule(values=genes_4, type_limit="Temperature")  # -> report, schedule, idf_text; plug-in component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
setpoint_2 = HBSetpoint(heating_sch=constantschedule_4.schedule, cooling_sch=constantschedule_3.schedule)  # -> setpoint; plug-in component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

colrange = LBColorRange(index="10")  # -> colors; plug-in component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
legendpar = LBLegendParameters(colors=colrange, num_decimals="0")  # -> leg_par; plug-in component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
mesh_join = MeshJoin(Meshes=flatten(genpts.mesh))
heatmap = LBSpatialHeatmap(
    values=flatten(utcimap.CSP),
    mesh=mesh_join,
    legend_par=legendpar,
    legend_title="%",
    global_title="Extreme Hot Week Heat Sensation")  # -> mesh, legend, title, colors, legend_par; plug-in component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

boolean_toggle_2 = BooleanToggle(True)
thermalmtx = HBReadThermalMatrix(comf_result=utcimap.utci, load=boolean_toggle_2)  # -> comf_mtx; plug-in component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
envmtx = HBReadEnvironmentMatrix(env_conds=utcimap.env_conds, metric=Slider(0, range=0..4), load=boolean_toggle_2)  # -> comf_mtx; plug-in component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
vizthermalmap = HBVisualizeThermalMap(comf_mtx=thermalmtx, mesh=flatten(mesh_join))  # -> out, mesh, legend, title, colors, values; plug-in component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

# ----
# 2013::Laboratory::Lab with fume hood
panel_10 = Panel("2013::MediumOffice::Conference")
panel_11 = Panel("2013::MediumOffice::ClosedOffice")
panel_12 = Panel("2013::MediumOffice::Corridor")
panel_13 = Panel("2013::Laboratory::Open lab")
panel_14 = Panel("2013::Laboratory::Office")
panel_15 = Panel("2013::MediumOffice::Storage")
panel_16 = Panel("2013::MediumOffice::Classroom")

geo_3 = Geometry(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)
door = HBDoor(geo=geo_3)  # -> report, doors; plug-in component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

geo_4 = Geometry([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])
shade_2 = HBShade(geo=geo_4, attached=Toggle(True))  # -> report, shades; plug-in component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
house_shades = Data(flatten(shade_2.shades))

# ----
# 划分网格
# 网格尺寸
number_slider_3 = Slider(1, range=0..1)

# ----
# 选IWEC版本的epw文件
# 选IWEC版本的ddy文件
ddy = FilePath("D:\courses\pm\DesignIV\Climatedata\shanghai\CHN_Shanghai.Shanghai.583670_IWEC.ddy")
# 选择气象数据
epw = FilePath("D:\courses\pm\DesignIV\Climatedata\shanghai\CHN_Shanghai.Shanghai.583670_IWEC.epw")

# ----
# PMV
# 选择计算时间段
number_slider_4 = Slider(6, range=1..12)
analysisperiod_2 = LBAnalysisPeriod(
    start_month=number_slider_4,
    start_day=Slider(1, range=1..31),
    start_hour=Slider(0, range=0..23),
    end_month=Slider(8, range=1..12),
    end_day=Slider(31, range=1..31),
    end_hour=Slider(23, range=0..23))  # -> period, hoys, dates; plug-in component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

toggle = BooleanToggle(False)

panel_17 = Panel("""0
10
11
22""")
number_slider_5 = Slider(21.8, range=0..100)
number_slider_6 = Slider(21.6, range=0..100)
colrange_2 = LBColorRange(index=panel_17)  # -> colors; plug-in component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
legendpar_2 = LBLegendParameters(colors=colrange_2)  # -> leg_par; plug-in component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
bang = ExplodeTree(Data=simplify(legendpar_2))  # -> Branch0, Branch1, Branch2, Branch3

# ----
# 共27套内置配色方案
number_slider_7 = Slider(19, range=0..26)
colrange_3 = LBColorRange(index=number_slider_7)  # -> colors; plug-in component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
legendpar_3 = LBLegendParameters(colors=colrange_3)  # -> leg_par; plug-in component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

panel_18 = Panel("""0
10
11
22""")
number_slider_8 = Slider(29, range=0..100)
number_slider_9 = Slider(40, range=0..100)
colrange_4 = LBColorRange(index=panel_18)  # -> colors; plug-in component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
legendpar_4 = LBLegendParameters(colors=colrange_4)  # -> leg_par; plug-in component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
bang_2 = ExplodeTree(Data=simplify(legendpar_4))  # -> Branch0, Branch1, Branch2, Branch3

panel_19 = Panel("""0
10
11
22""")
number_slider_10 = Slider(7, range=0..100)
number_slider_11 = Slider(23, range=0..100)
colrange_5 = LBColorRange(index=panel_19)  # -> colors; plug-in component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
legendpar_5 = LBLegendParameters(colors=colrange_5)  # -> leg_par; plug-in component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
bang_3 = ExplodeTree(Data=simplify(legendpar_5))  # -> Branch0, Branch1, Branch2, Branch3

panel_20 = Panel("""0
10
11
22""")
number_slider_12 = Slider(47, range=0..100)
number_slider_13 = Slider(55, range=0..100)
colrange_6 = LBColorRange(index=panel_20)  # -> colors; plug-in component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
legendpar_6 = LBLegendParameters(colors=colrange_6)  # -> leg_par; plug-in component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
bang_4 = ExplodeTree(Data=simplify(legendpar_6))  # -> Branch0, Branch1, Branch2, Branch3

# ----
# 修改时间表
# 一天中各个时间人数占上限的比例
# 上限人数=每平方米人数x房间面积
dayschedule_3 = HBDaySchedule(
    Decimals=2,
    Maximum=1,
    Minimum=0,
    Value=[0, 0, 0, 0, 0, 0, 0, 0.1, 0.25, 0.4, 0.4, 0.4, 0.4, 0.4, 0.4, 0.4, 0.4, 0.4, 0.4, 0.35, 0.25, 0, 0, 0])
data = Data(dayschedule)

data_2 = Data(dayschedule_3)

weeklyschedule = HBWeeklySchedule(sun=data, mon=data_2, tue=data_2, wed=data_2, thu=data_2, fri=data_2, sat=data)  # -> report, schedule, idf_year, idf_week, idf_days; plug-in component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
people = HBPeople(ppl_per_area=panel_7, occupancy_sch=weeklyschedule.schedule, activity_sch=decnstrpeople.activity_sch)  # -> people; plug-in component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
programtype = HBProgramType(base_program=list, people=people, setpoint=setpoint)  # -> program; plug-in component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

# ----
# 修改时间表
# 一天中各个时间人数占上限的比例
# 上限人数=每平方米人数x房间面积
dayschedule_4 = HBDaySchedule(
    Decimals=2,
    Maximum=1,
    Minimum=0,
    Value=[0, 0, 0, 0, 0, 0, 0, 0.1, 0.25, 0.4, 0.4, 0.4, 0.4, 0.4, 0.4, 0.4, 0.4, 0.4, 0.4, 0.35, 0.25, 0, 0, 0])
data_3 = Data(dayschedule_2)

data_4 = Data(dayschedule_4)

weeklyschedule_2 = HBWeeklySchedule(sun=data_3, mon=data_4, tue=data_4, wed=data_4, thu=data_4, fri=data_4, sat=data_3)  # -> report, schedule, idf_year, idf_week, idf_days; plug-in component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
people_2 = HBPeople(ppl_per_area=panel_8, occupancy_sch=weeklyschedule_2.schedule, activity_sch=decnstrpeople_2.activity_sch)  # -> people; plug-in component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
programtype_2 = HBProgramType(base_program=list_2, people=people_2, setpoint=setpoint_2)  # -> program; plug-in component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

# ----
# 解析构造属性
decnstrconstrset = HBDeconstructConstructionSet(constr_set=list_6)  # -> exterior_wall, exterior_roof, exposed_floor, ground_wall, ground_roof, ground_floor, window, skylight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; plug-in component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
decnstrconstr = HBDeconstructConstruction(constr=decnstrconstrset.window)  # -> materials, layers, r_val_si, r_val_ip, u_fac_si, u_fac_ip, shgc, t_sol, t_vis; plug-in component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
panel_21 = Panel([decnstrconstr.r_val_si, decnstrconstr.u_fac_si, decnstrconstr.shgc])

windowconstr = HBWindowConstruction(materials=merge)  # -> constr; plug-in component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
subfacesubset = HBSubfaceSubset(
    window=windowconstr,
    skylight=decnstrconstrset.skylight,
    operable=decnstrconstrset.operable,
    exterior_door=decnstrconstrset.exterior_door,
    overhead_door=decnstrconstrset.overhead_door,
    glass_door=decnstrconstrset.glass_door)  # -> subface_set; plug-in component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
constructionset = HBConstructionSet(base_constr_set=list_6, subface_subset=subfacesubset)  # -> constr_set; plug-in component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

decnstrconstr_2 = HBDeconstructConstruction(constr=windowconstr)  # -> materials, layers, r_val_si, r_val_ip, u_fac_si, u_fac_ip, shgc, t_sol, t_vis; plug-in component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
panel_22 = Panel([decnstrconstr_2.r_val_si, decnstrconstr_2.u_fac_si, decnstrconstr_2.shgc])

# ----
# 7个房间的模型
# 合并房间
# 开窗
# 建筑遮阳
功能属性 = Data(programtype_2)
构造属性 = Data(constructionset)

# ----
# 建筑模型
room_1 = Geometry(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)
intsolid = HBIntersectSolids(solids=flatten(room_1), run=Toggle(True))  # -> int_solids; plug-in component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
roomsolid_2 = HBRoomFromSolid(geo=flatten(intsolid), name="01", constr_set=构造属性, program=功能属性, conditioned=Toggle(True))  # -> report, rooms; plug-in component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

room_3 = Geometry(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)
intsolid_2 = HBIntersectSolids(solids=flatten(room_3), run=Toggle(True))  # -> int_solids; plug-in component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
roomsolid_3 = HBRoomFromSolid(geo=flatten(intsolid_2), name="03", constr_set=构造属性, program=功能属性, conditioned=Toggle(True))  # -> report, rooms; plug-in component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

room_2 = Geometry(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)
intsolid_3 = HBIntersectSolids(solids=flatten(room_2), run=Toggle(True))  # -> int_solids; plug-in component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
roomsolid_4 = HBRoomFromSolid(geo=flatten(intsolid_3), name="02", constr_set=构造属性, program=功能属性, conditioned=Toggle(True))  # -> report, rooms; plug-in component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

room_7 = Geometry(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)
intsolid_4 = HBIntersectSolids(solids=flatten(room_7), run=Toggle(True))  # -> int_solids; plug-in component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
roomsolid_5 = HBRoomFromSolid(geo=flatten(intsolid_4), name="07", constr_set=构造属性, program=programtype, conditioned=Toggle(True))  # -> report, rooms; plug-in component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

room_4 = Geometry(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)
intsolid_5 = HBIntersectSolids(solids=flatten(room_4), run=Toggle(True))  # -> int_solids; plug-in component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
roomsolid_6 = HBRoomFromSolid(geo=flatten(intsolid_5), name="04", constr_set=构造属性, program=功能属性, conditioned=Toggle(True))  # -> report, rooms; plug-in component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

room_6 = Geometry(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)
intsolid_6 = HBIntersectSolids(solids=flatten(room_6), run=Toggle(True))  # -> int_solids; plug-in component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
roomsolid_7 = HBRoomFromSolid(geo=flatten(intsolid_6), name="06", constr_set=构造属性, program=programtype, conditioned=Toggle(True))  # -> report, rooms; plug-in component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

room_5 = Geometry(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)
intsolid_7 = HBIntersectSolids(solids=flatten(room_5), run=Toggle(True))  # -> int_solids; plug-in component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
roomsolid_8 = HBRoomFromSolid(geo=flatten(intsolid_7), name="05", constr_set=构造属性, program=功能属性, conditioned=Toggle(True))  # -> report, rooms; plug-in component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

geo_5 = Geometry([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])
aperture = HBAperture(geo=geo_5)  # -> report, apertures; plug-in component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
bordershades = HBExtrudedBorderShades(hb_objs=flatten(aperture.apertures), depth="0.3")  # -> report, hb_objs; plug-in component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
addsubface = HBAddSubface(
    hb_obj=flatten([roomsolid_2.rooms, roomsolid_4.rooms, roomsolid_3.rooms, roomsolid_6.rooms, roomsolid_8.rooms, roomsolid_7.rooms, roomsolid_5.rooms]),
    sub_faces=flatten([bordershades.hb_objs, door.doors]))  # -> hb_obj; plug-in component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

solveadj = HBSolveAdjacency(rooms=flatten(addsubface), run=Toggle(True))  # -> report, adj_rooms; plug-in component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
vizbytype = HBVisualizeByType(hb_objs=solveadj.adj_rooms)  # -> walls, interior_walls, roofs, ceilings, exterior_floors, interior_floors, air_walls, apertures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; plug-in component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
geo_6 = Geometry(vizbytype.walls)

house_rooms = Data(flatten(solveadj.adj_rooms))

# ----
# 需要绘制哪几个房间的图，就输出哪几个房间的grid
model_2 = HBModel(rooms=flatten(house_rooms), shades=flatten(house_shades))  # -> report, model; plug-in component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
gridrooms = HBSensorGridFromRooms(rooms=house_rooms, grid_size=number_slider_3)  # -> grid, points, mesh; plug-in component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
vizwiref_2 = HBVisualizeWireframe(hb_objs=flatten(model_2.model))  # -> geo; plug-in component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

# ----
# 放大视野，右边可显示+-号，
# 根据房间数量增减爆炸结果的数量
bang_5 = ExplodeTree(Data=graft(gridrooms.grid))  # -> Branch0, Branch1, Branch2, Branch3, Branch4, Branch5, Branch6

assigngridsviews_2 = HBAssignGridsAndViews(model=model_2.model, grids=flatten(bang_5.Branch0))  # -> model; plug-in component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
assigngridsviews_3 = HBAssignGridsAndViews(model=model_2.model, grids=flatten(bang_5.Branch2))  # -> model; plug-in component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
assigngridsviews_4 = HBAssignGridsAndViews(model=model_2.model, grids=flatten(bang_5.Branch1))  # -> model; plug-in component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
assigngridsviews_5 = HBAssignGridsAndViews(model=model_2.model, grids=flatten(bang_5.Branch3))  # -> model; plug-in component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

assigngridsviews_6 = HBAssignGridsAndViews(model=model_2.model, grids=flatten(bang_5.Branch4))  # -> model; plug-in component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
assigngridsviews_7 = HBAssignGridsAndViews(model=model_2.model, grids=flatten(bang_5.Branch5))  # -> model; plug-in component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
assigngridsviews_8 = HBAssignGridsAndViews(model=model_2.model, grids=flatten(bang_5.Branch6))  # -> model; plug-in component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
assigngridsviews_9 = HBAssignGridsAndViews(model=model_2.model, grids=flatten(bang_5.Branch6))  # -> model; plug-in component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

# ----
# 不确定哪个mesh对应哪个房间的话，
# 可以把右边的data打开看看在哪
bang_6 = ExplodeTree(Data=graft(gridrooms.mesh))  # -> Branch0, Branch1, Branch2, Branch3, Branch4, Branch5, Branch6

pmvmap = HBPMVComfortMap(model=assigngridsviews_2, epw=epw, ddy=ddy, run=Toggle(False))  # -> report, env_conds, temperature, condition, pmv, TCP, HSP, CSP; plug-in component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

pmvmap_2 = HBPMVComfortMap(model=assigngridsviews_4, epw=epw, ddy=ddy, run=toggle)  # -> report, env_conds, temperature, condition, pmv, TCP, HSP, CSP; plug-in component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
data_5 = Data(bang_6.Branch1)

pmvmap_3 = HBPMVComfortMap(model=assigngridsviews_5, epw=epw, ddy=ddy, run=toggle)  # -> report, env_conds, temperature, condition, pmv, TCP, HSP, CSP; plug-in component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
data_6 = Data(bang_6.Branch3)

pmvmap_4 = HBPMVComfortMap(model=assigngridsviews_3, epw=epw, ddy=ddy, run=toggle)  # -> report, env_conds, temperature, condition, pmv, TCP, HSP, CSP; plug-in component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
data_7 = Data(bang_6.Branch2)

pmvmap_5 = HBPMVComfortMap(model=assigngridsviews_6, epw=epw, ddy=ddy, run=toggle)  # -> report, env_conds, temperature, condition, pmv, TCP, HSP, CSP; plug-in component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
data_8 = Data(bang_6.Branch4)

pmvmap_6 = HBPMVComfortMap(model=assigngridsviews_8, epw=epw, ddy=ddy, run=toggle)  # -> report, env_conds, temperature, condition, pmv, TCP, HSP, CSP; plug-in component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
data_9 = Data(bang_6.Branch6)

# ----
# 不确定这是哪个房间？把这个data打开看看
data_10 = Data(bang_6.Branch0)

pmvmap_7 = HBPMVComfortMap(model=assigngridsviews_7, epw=epw, ddy=ddy, run=toggle)  # -> report, env_conds, temperature, condition, pmv, TCP, HSP, CSP; plug-in component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
data_11 = Data(bang_6.Branch5)

thermalmtx_2 = HBReadThermalMatrix(comf_result=pmvmap.temperature, load=Toggle(True))  # -> comf_mtx; plug-in component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
move = Move(Geometry=data_10, Motion="30,0,0")  # -> Geometry, Transform
vizthermalmap_2 = HBVisualizeThermalMap(comf_mtx=thermalmtx_2, mesh=flatten(move.Geometry), legend_par=bang.Branch0)  # -> report, mesh, legend, title, colors, values; plug-in component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

thermalmtx_3 = HBReadThermalMatrix(comf_result=pmvmap_2.temperature, load=Toggle(True))  # -> comf_mtx; plug-in component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
move_2 = Move(Geometry=data_5, Motion="60,0,0")  # -> Geometry, Transform
vizthermalmap_3 = HBVisualizeThermalMap(comf_mtx=thermalmtx_3, mesh=flatten(move_2.Geometry), legend_par=bang.Branch0)  # -> report, mesh, legend, title, colors, values; plug-in component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

thermalmtx_4 = HBReadThermalMatrix(comf_result=pmvmap_3.temperature, load=Toggle(True))  # -> comf_mtx; plug-in component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
move_3 = Move(Geometry=data_6, Motion="120,0,0")  # -> Geometry, Transform
vizthermalmap_4 = HBVisualizeThermalMap(comf_mtx=thermalmtx_4, mesh=flatten(move_3.Geometry), legend_par=bang.Branch0)  # -> report, mesh, legend, title, colors, values; plug-in component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

thermalmtx_5 = HBReadThermalMatrix(comf_result=pmvmap_4.temperature, load=Toggle(True))  # -> comf_mtx; plug-in component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
move_4 = Move(Geometry=data_7, Motion="90,0,0")  # -> Geometry, Transform
vizthermalmap_5 = HBVisualizeThermalMap(comf_mtx=thermalmtx_5, mesh=flatten(move_4.Geometry), legend_par=bang.Branch0)  # -> report, mesh, legend, title, colors, values; plug-in component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

thermalmtx_6 = HBReadThermalMatrix(comf_result=pmvmap_5.temperature, load=Toggle(True))  # -> comf_mtx; plug-in component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
move_5 = Move(Geometry=data_8, Motion="150,0,0")  # -> Geometry, Transform
vizthermalmap_6 = HBVisualizeThermalMap(comf_mtx=thermalmtx_6, mesh=flatten(move_5.Geometry), legend_par=bang.Branch0)  # -> report, mesh, legend, title, colors, values; plug-in component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

thermalmtx_7 = HBReadThermalMatrix(comf_result=pmvmap_6.temperature, load=Toggle(True))  # -> comf_mtx; plug-in component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
move_6 = Move(Geometry=data_9, Motion="210,0,0")  # -> Geometry, Transform
vizthermalmap_7 = HBVisualizeThermalMap(comf_mtx=thermalmtx_7, mesh=flatten(move_6.Geometry), legend_par=bang.Branch0)  # -> report, mesh, legend, title, colors, values; plug-in component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

thermalmtx_8 = HBReadThermalMatrix(comf_result=pmvmap_7.temperature, load=Toggle(True))  # -> comf_mtx; plug-in component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
move_7 = Move(Geometry=data_11, Motion="180,0,0")  # -> Geometry, Transform
vizthermalmap_8 = HBVisualizeThermalMap(comf_mtx=thermalmtx_8, mesh=flatten(move_7.Geometry), legend_par=bang.Branch0)  # -> report, mesh, legend, title, colors, values; plug-in component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

# ----
# 舒适时间占比
panel_23 = Panel("30,-10,0")
move_8 = Move(Geometry=data_10, Motion=panel_23)  # -> Geometry, Transform
heatmap_2 = LBSpatialHeatmap(values=pmvmap.TCP, mesh=move_8.Geometry, legend_par=bang_2.Branch3, legend_title="TCP%")  # -> mesh, legend, title, colors, legend_par; plug-in component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

# ----
# 舒适时间占比
panel_24 = Panel("60,-10,0")
move_9 = Move(Geometry=data_5, Motion=panel_24)  # -> Geometry, Transform
heatmap_3 = LBSpatialHeatmap(values=pmvmap_2.TCP, mesh=move_9.Geometry, legend_par=bang_2.Branch3, legend_title="TCP%")  # -> mesh, legend, title, colors, legend_par; plug-in component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

# ----
# 舒适时间占比
panel_25 = Panel("120,-10,0")
move_10 = Move(Geometry=data_6, Motion=panel_25)  # -> Geometry, Transform
heatmap_4 = LBSpatialHeatmap(values=pmvmap_3.TCP, mesh=move_10.Geometry, legend_par=bang_2.Branch3, legend_title="TCP%")  # -> mesh, legend, title, colors, legend_par; plug-in component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

# ----
# 舒适时间占比
panel_26 = Panel("90,-10,0")
move_11 = Move(Geometry=data_7, Motion=panel_26)  # -> Geometry, Transform
heatmap_5 = LBSpatialHeatmap(values=pmvmap_4.TCP, mesh=move_11.Geometry, legend_par=bang_2.Branch3, legend_title="TCP%")  # -> mesh, legend, title, colors, legend_par; plug-in component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

# ----
# 舒适时间占比
panel_27 = Panel("150,-10,0")
move_12 = Move(Geometry=data_8, Motion=panel_27)  # -> Geometry, Transform
heatmap_6 = LBSpatialHeatmap(values=pmvmap_5.TCP, mesh=move_12.Geometry, legend_par=bang_2.Branch3, legend_title="TCP%")  # -> mesh, legend, title, colors, legend_par; plug-in component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

# ----
# 舒适时间占比
panel_28 = Panel("210,-10,0")
move_13 = Move(Geometry=data_9, Motion=panel_28)  # -> Geometry, Transform
heatmap_7 = LBSpatialHeatmap(values=pmvmap_6.TCP, mesh=move_13.Geometry, legend_par=bang_2.Branch3, legend_title="TCP%")  # -> mesh, legend, title, colors, legend_par; plug-in component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

# ----
# 舒适时间占比
panel_29 = Panel("180,-10,0")
move_14 = Move(Geometry=data_11, Motion=panel_29)  # -> Geometry, Transform
heatmap_8 = LBSpatialHeatmap(values=pmvmap_7.TCP, mesh=move_14.Geometry, legend_par=bang_2.Branch3, legend_title="TCP%")  # -> mesh, legend, title, colors, legend_par; plug-in component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

# ----
# 过热时间占比
panel_30 = Panel("30,-20,0")
move_15 = Move(Geometry=data_10, Motion=panel_30)  # -> Geometry, Transform
heatmap_9 = LBSpatialHeatmap(values=pmvmap.HSP, mesh=move_15.Geometry, legend_par=bang_3.Branch1, legend_title="HSP%")  # -> mesh, legend, title, colors, legend_par; plug-in component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

# ----
# 过热时间占比
panel_31 = Panel("60,-20,0")
move_16 = Move(Geometry=data_5, Motion=panel_31)  # -> Geometry, Transform
heatmap_10 = LBSpatialHeatmap(values=pmvmap_2.HSP, mesh=move_16.Geometry, legend_par=bang_3.Branch1, legend_title="HSP%")  # -> mesh, legend, title, colors, legend_par; plug-in component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

# ----
# 过热时间占比
panel_32 = Panel("120,-20,0")
move_17 = Move(Geometry=data_6, Motion=panel_32)  # -> Geometry, Transform
heatmap_11 = LBSpatialHeatmap(values=pmvmap_3.HSP, mesh=move_17.Geometry, legend_par=bang_3.Branch1, legend_title="HSP%")  # -> mesh, legend, title, colors, legend_par; plug-in component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

# ----
# 过热时间占比
panel_33 = Panel("90,-20,0")
move_18 = Move(Geometry=data_7, Motion=panel_33)  # -> Geometry, Transform
heatmap_12 = LBSpatialHeatmap(values=pmvmap_4.HSP, mesh=move_18.Geometry, legend_par=bang_3.Branch1, legend_title="HSP%")  # -> mesh, legend, title, colors, legend_par; plug-in component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

# ----
# 过热时间占比
panel_34 = Panel("150,-20,0")
move_19 = Move(Geometry=data_8, Motion=panel_34)  # -> Geometry, Transform
heatmap_13 = LBSpatialHeatmap(values=pmvmap_5.HSP, mesh=move_19.Geometry, legend_par=bang_3.Branch1, legend_title="HSP%")  # -> mesh, legend, title, colors, legend_par; plug-in component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

# ----
# 过热时间占比
panel_35 = Panel("210,-20,0")
move_20 = Move(Geometry=data_9, Motion=panel_35)  # -> Geometry, Transform
heatmap_14 = LBSpatialHeatmap(values=pmvmap_6.HSP, mesh=move_20.Geometry, legend_par=bang_3.Branch1, legend_title="HSP%")  # -> mesh, legend, title, colors, legend_par; plug-in component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

# ----
# 过热时间占比
panel_36 = Panel("180,-20,0")
move_21 = Move(Geometry=data_11, Motion=panel_36)  # -> Geometry, Transform
heatmap_15 = LBSpatialHeatmap(values=pmvmap_7.HSP, mesh=move_21.Geometry, legend_par=bang_3.Branch1, legend_title="HSP%")  # -> mesh, legend, title, colors, legend_par; plug-in component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

# ----
# 过冷时间占比
panel_37 = Panel("30,-30,0")
move_22 = Move(Geometry=data_10, Motion=panel_37)  # -> Geometry, Transform
heatmap_16 = LBSpatialHeatmap(values=pmvmap.CSP, mesh=move_22.Geometry, legend_par=bang_4.Branch2, legend_title="CSP%")  # -> mesh, legend, title, colors, legend_par; plug-in component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

# ----
# 过冷时间占比
panel_38 = Panel("60,-30,0")
move_23 = Move(Geometry=data_5, Motion=panel_38)  # -> Geometry, Transform
heatmap_17 = LBSpatialHeatmap(values=pmvmap_2.CSP, mesh=move_23.Geometry, legend_par=bang_4.Branch2, legend_title="CSP%")  # -> mesh, legend, title, colors, legend_par; plug-in component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

# ----
# 过冷时间占比
panel_39 = Panel("120,-30,0")
move_24 = Move(Geometry=data_6, Motion=panel_39)  # -> Geometry, Transform
heatmap_18 = LBSpatialHeatmap(values=pmvmap_3.CSP, mesh=move_24.Geometry, legend_par=bang_4.Branch2, legend_title="CSP%")  # -> mesh, legend, title, colors, legend_par; plug-in component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

# ----
# 过冷时间占比
panel_40 = Panel("90,-30,0")
move_25 = Move(Geometry=data_7, Motion=panel_40)  # -> Geometry, Transform
heatmap_19 = LBSpatialHeatmap(values=pmvmap_4.CSP, mesh=move_25.Geometry, legend_par=bang_4.Branch2, legend_title="CSP%")  # -> mesh, legend, title, colors, legend_par; plug-in component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

# ----
# 过冷时间占比
panel_41 = Panel("150,-30,0")
move_26 = Move(Geometry=data_8, Motion=panel_41)  # -> Geometry, Transform
heatmap_20 = LBSpatialHeatmap(values=pmvmap_5.CSP, mesh=move_26.Geometry, legend_par=bang_4.Branch2, legend_title="CSP%")  # -> mesh, legend, title, colors, legend_par; plug-in component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

# ----
# 过冷时间占比
panel_42 = Panel("210,-30,0")
move_27 = Move(Geometry=data_9, Motion=panel_42)  # -> Geometry, Transform
heatmap_21 = LBSpatialHeatmap(values=pmvmap_6.CSP, mesh=move_27.Geometry, legend_par=bang_4.Branch2, legend_title="CSP%")  # -> mesh, legend, title, colors, legend_par; plug-in component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

# ----
# 过冷时间占比
panel_43 = Panel("180,-30,0")
move_28 = Move(Geometry=data_11, Motion=panel_43)  # -> Geometry, Transform
heatmap_22 = LBSpatialHeatmap(values=pmvmap_7.CSP, mesh=move_28.Geometry, legend_par=bang_4.Branch2, legend_title="CSP%")  # -> mesh, legend, title, colors, legend_par; plug-in component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
