# Grasshopper definition 热舒适.gh (Grasshopper 1.0.7)
# plug-ins: Bifocals, Human, Octopus, Hare

# ----
# 中空玻璃窗
panel = Panel("Glass")
searchmats = HBSearchMaterials(keywords=panel)  # -> opaque_mats, window_mats; plug-in component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
searchmats_2 = HBSearchMaterials(keywords="mm")  # -> opaque_mats, window_mats; plug-in component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
searchmats_3 = HBSearchMaterials(keywords=panel)  # -> opaque_mats, window_mats; plug-in component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
list = ItemSelector(
    searchmats_2.window_mats,
    {"AIR 13MM", "AIR 3MM", "AIR 6MM", "ARGON 13MM", "BLUE 6MM", "BRONZE 6MM", "CLEAR 2.5MM", "CLEAR 3MM", "CLEAR 6MM", "Clear 3mm"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}, selected="AIR 13MM")
list_2 = ItemSelector(
    searchmats.window_mats,
    {"Generic Clear Glass", "Generic Low-e Glass", "Glass_2010F_LayerAvg", "Glass_2022F_LayerAvg", "Glass_2027F_LayerAvg", "Glass_2052_LayerAvg", "Glass_2175_LayerAvg", "Theoretical Glass 297", "Theoretical Glass 347", "Theoretical Glass [167]", "Theoretical Glass [197]", "Theoretical Glass [202]", "Theoretical Glass [207]", "Theoretical Glass [216]", "Theoretical Glass [221]"}, selected="Generic Low-e Glass")
list_3 = ItemSelector(
    searchmats_3.window_mats,
    {"Generic Clear Glass", "Generic Low-e Glass", "Glass_2010F_LayerAvg", "Glass_2022F_LayerAvg", "Glass_2027F_LayerAvg", "Glass_2052_LayerAvg", "Glass_2175_LayerAvg", "Theoretical Glass 297", "Theoretical Glass 347", "Theoretical Glass [167]", "Theoretical Glass [197]", "Theoretical Glass [202]", "Theoretical Glass [207]", "Theoretical Glass [216]", "Theoretical Glass [221]"}, selected="Theoretical Glass 347")
merge = Merge(Data1=list_2, Data2=list, Data3=list_3)

# ----
# 选择基础房间功能属性
bldgvintages = HBBuildingVintages({"ASHRAE 90.1 2019  |  IECC 2021": "2019", "ASHRAE 90.1 2016  |  IECC 2018": "2016", "ASHRAE 90.1 2013  |  IECC 2015": "2013", "ASHRAE 90.1 2010  |  IECC 2012": "2010", "ASHRAE 90.1 2007  |  IECC 2009": "2007", "ASHRAE 90.1 2004  |  IECC 2006": "2004", "1980-2004 (CBECS)": "1980_2004", "Pre-1980 (CBECS)": "pre_1980"}, selected="ASHRAE 90.1 2019  |  IECC 2021")
# 前期设定
bldgprograms = HBBuildingPrograms({"LargeOffice", "MediumOffice", "SmallOffice", "MidriseApartment", "HighriseApartment", "Retail", "StripMall", "PrimarySchool", "SecondarySchool", "SmallHotel", "LargeHotel", "Hospital", "Outpatient", "Laboratory", "Warehouse", "SuperMarket", "FullServiceRestaurant", "QuickServiceRestaurant", "Courthouse", "LargeDataCenterHighITE", "LargeDataCenterLowITE", "SmallDataCenterHighITE", "SmallDataCenterLowITE"}, selected="PrimarySchool")
searchprog = HBSearchPrograms(bldg_prog=bldgprograms, vintage=bldgvintages)  # -> room_prog; plug-in component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
list_4 = ItemSelector(
    searchprog,
    {"2019::PrimarySchool::Cafeteria", "2019::PrimarySchool::Classroom", "2019::PrimarySchool::ComputerRoom", "2019::PrimarySchool::Corridor", "2019::PrimarySchool::Gym", "2019::PrimarySchool::Kitchen", "2019::PrimarySchool::Library", "2019::PrimarySchool::Lobby", "2019::PrimarySchool::Mechanical", "2019::PrimarySchool::Office", "2019::PrimarySchool::Restroom"}, selected="2019::PrimarySchool::Classroom")

# ----
# 选择房间构造属性
panel_2 = Panel("2019::ClimateZone3")
searchconstrset = HBSearchConstructionSets(keywords=panel_2)  # -> constr_sets; plug-in component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
list_5 = ItemSelector(
    searchconstrset,
    {"2019::ClimateZone3::Mass", "2019::ClimateZone3::Metal Building", "2019::ClimateZone3::SteelFramed", "2019::ClimateZone3::WoodFramed"}, selected="2019::ClimateZone3::Mass")

panel_3 = Panel(searchmats.window_mats)
# 一天中各个时间人数占上限的比例
# 上限人数=每平方米人数x房间面积
decnstrconstrset = HBDeconstructConstructionSet(constr_set=list_5)  # -> exterior_wall, exterior_roof, exposed_floor, ground_wall, ground_roof, ground_floor, window, skylight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; plug-in component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

# ---- group: Gene Pool
dayschedule = HBDaySchedule(Decimals=2, Maximum=1, Minimum=0, Value=[0, 0, 0, 0, 0, 0, 0, 0, 0, 0, 0, 0, 0, 0, 0, 0, 0, 0, 0, 0, 0, 0, 0, 0])

# ----
dayschedule_2 = HBDaySchedule(
    Decimals=2,
    Maximum=1,
    Minimum=0,
    Value=[0, 0, 0, 0, 0, 0, 0, 0, 0.25, 0.4, 0.4, 0.4, 0.4, 0.4, 0.4, 0.4, 0.4, 0.4, 0.4, 0, 0, 0, 0, 0])
windowconstr = HBWindowConstruction(materials=merge)  # -> constr; plug-in component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
deconstrprogram = HBDeconstructProgramType(program=list_4)  # -> people, lighting, electric_equip, gas_equip, hot_water, infiltration, ventilation, setpoint; plug-in component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
decnstrpeople = HBDeconstructPeople(people=deconstrprogram.people)  # -> name, ppl_per_area, occupancy_sch, activity_sch; plug-in component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
data = Data(dayschedule_2)
data_2 = Data(dayschedule)
subfacesubset = HBSubfaceSubset(
    window=windowconstr,
    skylight=decnstrconstrset.skylight,
    operable=decnstrconstrset.operable,
    exterior_door=decnstrconstrset.exterior_door,
    overhead_door=decnstrconstrset.overhead_door,
    glass_door=decnstrconstrset.glass_door)  # -> subface_set; plug-in component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
weeklyschedule = HBWeeklySchedule(sun=data_2, mon=data, tue=data, wed=data, thu=data, fri=data, sat=data_2)  # -> report, schedule, idf_year, idf_week, idf_days; plug-in component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
constructionset = HBConstructionSet(base_constr_set=list_5, subface_subset=subfacesubset)  # -> constr_set; plug-in component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
# 每平方米人数
panel_4 = Panel(decnstrpeople.ppl_per_area)
people = HBPeople(ppl_per_area="0.625", occupancy_sch=weeklyschedule.schedule, activity_sch=decnstrpeople.activity_sch)  # -> people; plug-in component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
brep = Brep(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)
# 中空玻璃窗
panel_5 = Panel("0")
programtype = HBProgramType(base_program=list_4, people=people)  # -> program; plug-in component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
# 教室
brep_2 = Brep(brep)
brep_3 = Brep(brep_2)
cluster = Cluster(brep=brep_3, _0上1下=panel_5)
area = Area(Geometry=cluster)  # -> Area, Centroid
multiplication = Multiplication(A=area.Area, B="0.2")
功能属性 = Data(programtype)
反射率 = Slider(0.75, range=0..1)
反射率_2 = Slider(0.4, range=0..1)
反射率_3 = Slider(0.75, range=0..1)
panel_6 = Panel(multiplication)
division = Division(A=multiplication)
opaquemod = HBOpaqueModifier(reflect=反射率_2)  # -> modifier; plug-in component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
opaquemod_2 = HBOpaqueModifier(reflect=反射率)  # -> modifier; plug-in component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
opaquemod_3 = HBOpaqueModifier(reflect=反射率_3)  # -> modifier; plug-in component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
# 房间模型
room_1 = Geometry(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)
number_slider = Slider(3, range=2..5)
roomsolid = HBRoomFromSolid(geo=flatten(brep_2), conditioned=True)  # -> report, rooms; plug-in component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
窗墙比 = Slider(0.5, range=0.2..0.5)
intsolid = HBIntersectSolids(solids=flatten(room_1), run=Toggle(True))  # -> int_solids; plug-in component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
bldgvintages_2 = HBBuildingVintages({"ASHRAE 90.1 2019  |  IECC 2021": "2019", "ASHRAE 90.1 2016  |  IECC 2018": "2016", "ASHRAE 90.1 2013  |  IECC 2015": "2013", "ASHRAE 90.1 2010  |  IECC 2012": "2010", "ASHRAE 90.1 2007  |  IECC 2009": "2007", "ASHRAE 90.1 2004  |  IECC 2006": "2004", "1980-2004 (CBECS)": "1980_2004", "Pre-1980 (CBECS)": "pre_1980"}, selected="ASHRAE 90.1 2019  |  IECC 2021")
exteriorsubset = HBExteriorModifierSubset(exterior_wall=opaquemod_3, exterior_roof=opaquemod_2, exposed_floor=opaquemod)  # -> exterior_set; plug-in component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
bldgprograms_2 = HBBuildingPrograms({"LargeOffice", "MediumOffice", "SmallOffice", "MidriseApartment", "HighriseApartment", "Retail", "StripMall", "PrimarySchool", "SecondarySchool", "SmallHotel", "LargeHotel", "Hospital", "Outpatient", "Laboratory", "Warehouse", "SuperMarket", "FullServiceRestaurant", "QuickServiceRestaurant", "Courthouse", "College", "LargeDataCenterHighITE", "LargeDataCenterLowITE", "SmallDataCenterHighITE", "SmallDataCenterLowITE"}, selected="PrimarySchool")
toggle = BooleanToggle(True)
division_2 = Division(A=Slider(9, range=0..10), B=number_slider)
entwine = Entwine(Branch00=窗墙比, Branch01=number_slider, FlattenInputs=True)
窗墙比_2 = Slider(0.5, range=0.2..0.5)
facparam = HBFacadeParameters(north=0, east=0, south=窗墙比_2, west=0)  # -> fac_par; plug-in component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
aperturesbyratio = HBAperturesByRatio(hb_objs=roomsolid.rooms, ratio=facparam, sill_height=Slider(0.9, range=0..1), horiz_separ=division_2)  # -> out, hb_objs; plug-in component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
intsolid_2 = HBIntersectSolids(rooms=flatten(brep_2), cpu_count=toggle, run=toggle)  # -> int_rooms; plug-in component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
构造属性 = Data(constructionset)
modifierset = HBModifierSet(exterior_subset=exteriorsubset)  # -> mod_set; plug-in component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
searchprog_2 = HBSearchPrograms(bldg_prog=bldgprograms_2, vintage=bldgvintages_2)  # -> room_prog; plug-in component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
R = RecordeData(Data=entwine)
R_2 = RecordeData(Data=窗墙比_2)
facesbytype = HBFacesByType(hb_objs=aperturesbyratio.hb_objs)  # -> walls, interior_walls, roofs, ceilings, exterior_floors, interior_floors, air_walls, apertures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; plug-in component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
number_slider_2 = Slider(3, range=2..5)
rev = ReverseList(List=R_2)
roomsolid_2 = HBRoomFromSolid(geo=flatten(room_1), constr_set=构造属性, program=功能属性, conditioned=Toggle(True))  # -> report, rooms; plug-in component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
geo = Geometry(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)
geo_2 = Geometry(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)
geo_3 = Geometry(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)
geo_4 = Geometry(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)
number_slider_3 = Slider(3, range=0..10)
facparam_2 = HBFacadeParameters(north=0, east=0, south=窗墙比_2, west=0)  # -> fac_par; plug-in component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
clean = CleanTree(RemoveNulls=True, RemoveInvalid=True, RemoveEmpty=False, Tree=R)

走廊间距 = Slider(0.8, range=0..1)
前后间距 = Slider(0.9, range=0..1)
y轴移动距离 = Slider(0.9, range=0..10)
x轴移动距离 = Slider(12.2, range=0..13)
# 普通教室
value_list = ValueList({"单人课桌": 0, "双人课桌": 1}, selected="双人课桌")
cluster_2 = Cluster_3(矩形范围=geo, 座位类型=value_list, 走廊间距=走廊间距, 前后间距=前后间距, x轴移动距离=x轴移动距离, y轴移动距离=y轴移动距离, 座位排布范围_矩形=geo_2, 视域排布范围=geo_3, 最佳视域=geo_4)  # -> 课桌椅, 座位个数, 课桌椅建模, 最佳视域座位, 最佳视域座位个数

roomsolid_3 = HBRoomFromSolid(geo=flatten(intsolid_2), mod_set=modifierset, program=searchprog_2, conditioned=True)  # -> report, rooms; plug-in component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
bang = ExplodeTree(Data=clean)  # -> Branch0, Branch1
division_3 = Division(A=Slider(9, range=0..10), B=number_slider_2)
panel_7 = Panel(rev)
vizwiref = HBVizualizeWireframe(hb_objs=flatten(facesbytype.apertures))  # -> geo; plug-in component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
R_3 = RecordeData(Data=number_slider_2)
glassmod = HBGlassModifier(trans=Slider(0.65, range=0..1))  # -> modifier; plug-in component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
aperturesbyratio_2 = HBAperturesByRatio(hb_objs=roomsolid_2.rooms, ratio=facparam_2, sill_height=Slider(0.9, range=0..1), horiz_separ=division_3)  # -> out, hb_objs; plug-in component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
rev_2 = ReverseList(List=R_3)
boundary = BoundarySurfaces(Edges=vizwiref)
solveadj = HBSolveAdjacency(rooms=flatten(roomsolid_3.rooms), run=toggle)  # -> report, adj_rooms; plug-in component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
entwine_2 = Entwine(Branch00=x轴移动距离, Branch01=y轴移动距离, FlattenInputs=True)
panel_8 = Panel(rev_2)
facesbytype_2 = HBFacesByType(hb_objs=aperturesbyratio_2.hb_objs)  # -> walls, interior_walls, roofs, ceilings, exterior_floors, interior_floors, air_walls, apertures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; plug-in component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
aperture = HBAperture(geo=boundary, rad_mod=glassmod)  # -> report, apertures; plug-in component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

最佳视域座位个数 = Number(cluster_2.最佳视域座位个数)
课桌椅建模 = Brep(cluster_2.课桌椅建模)
座位个数 = Number(cluster_2.座位个数)
division_4 = Division(A=最佳视域座位个数, B=座位个数)
视距优座率 = Number(division_4)

curve = Curve(flatten(cluster_2.课桌椅))
addsubface = HBAddSubface(hb_obj=flatten(solveadj.adj_rooms), sub_faces=flatten(aperture.apertures))  # -> hb_obj; plug-in component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
previewlw = CustomPreviewLineweights(Geometry=cluster_2.最佳视域座位, Shader=ColourSwatch(SwatchColor=RGB(145, 0, 0)), Absolute=False)
model = HBModel(rooms=flatten(addsubface))  # -> report, model; plug-in component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
neg = Negative(Value=视距优座率)
addsubface_2 = HBAddSubface(hb_obj=flatten(roomsolid_2.rooms), sub_faces=flatten(facesbytype_2.apertures))  # -> hb_obj; plug-in component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
视距优座率_2 = Number(neg)
gridrooms = HBSensorGridFromRooms(rooms=addsubface, grid_size=Slider(0.5, range=0..1), dist_floor=Slider(0.8, range=0..1))  # -> grid, points, mesh; plug-in component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

# ----
# 合并房间
solveadj_2 = HBSolveAdjacency(rooms=flatten(addsubface_2), run=Toggle(True))  # -> report, adj_rooms; plug-in component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

octopus = Octopus(OctopusData_gene=[窗墙比_2, number_slider, x轴移动距离, y轴移动距离], OctopusData_obj=[全年平均热舒适温度时间占比, udi, 视距优座率_2])
galapagos = Galapagos(fitness=全年平均热舒适温度时间占比, gene=[窗墙比_2, number_slider_2])
assigngridsviews = HBAssignGridsAndViews(model=model.model, grids=flatten(gridrooms.grid))  # -> model; plug-in component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
panel_9 = Panel(视距优座率_2)
照度 = Panel("-lt 450 -ut 2000")
house_rooms = Data(flatten(solveadj_2.adj_rooms))
# DF（采光系数）
daylightfactor = HBDaylightFactor(model=assigngridsviews, run=Toggle(False))  # -> report, results; plug-in component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
toggle_2 = BooleanToggle(True)
model_2 = HBModel(rooms=flatten(house_rooms))  # -> report, model; plug-in component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
simoutput = HBSimulationOutput(
    zone_energy_use=toggle_2,
    system_energy_use=toggle_2,
    gains_and_losses=toggle_2,
    comfort_metrics=toggle_2,
    surface_temperature=toggle_2,
    surface_energy_flow=toggle_2)  # -> report, sim_output; plug-in component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
# 划分网格
# 网格尺寸
number_slider_4 = Slider(0.5, range=0..1)
simpar = HBSimulationParameter(output=simoutput.sim_output, timestep=6)  # -> sim_par; plug-in component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
gridrooms_2 = HBSensorGridFromRooms(rooms=house_rooms, grid_size=number_slider_4)  # -> grid, points, mesh; plug-in component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
panel_10 = Panel("https://energyplus-weather.s3.amazonaws.com/asia_wmo_region_2/CHN/CHN_Hubei.Wuhan.574940_SWERA/CHN_Hubei.Wuhan.574940_SWERA.zip")
downloadepw = LBDownloadWeather(weather_URL=panel_10)  # -> epw_file, stat_file, ddy_file; plug-in component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
wea = HBWeaFromEPW(epw_file=downloadepw.epw_file)  # -> wea; plug-in component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
annualdaylight = HBAnnualDaylight(model=assigngridsviews, wea=wea, thresholds=照度, run=Toggle(False))  # -> report, results, DA, cDA, UDI, UDI_low, UDI_up; plug-in component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
avr = Average(Input=annualdaylight.UDI)
neg_2 = Negative(Value=avr)
R_4 = RecordeData(Data=avr)
udi = Number(neg_2)
panel_11 = Panel(udi)
modeltoosm = HBModelToOSM(model=model_2.model, epw_file=downloadepw.epw_file, sim_par=simpar, write=toggle_2, run=toggle_2)  # -> report, jsons, osw, osm, idf, sql, zsz, rdd, html; plug-in component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
assigngridsviews_2 = HBAssignGridsAndViews(model=model_2.model, grids=flatten(gridrooms_2.grid))  # -> model; plug-in component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
roomcomfortresult = HBReadRoomComfortResult(sql=modeltoosm.sql)  # -> oper_temp, air_temp, rad_temp, rel_humidity, unmet_heat, unmet_cool; plug-in component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
importepw = LBImportEPW(epw_file=downloadepw.epw_file)  # -> location, dry_bulb_temperature, dew_point_temperature, relative_humidity, wind_speed, wind_direction, direct_normal_rad, diffuse_horizontal_rad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; plug-in component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
colorrooms = HBColorRooms(data=flatten(roomcomfortresult.oper_temp), rooms_model=flatten(model_2.model))  # -> report, mesh, wire_frame, legend, title, rooms, colors, values, vis_set; plug-in component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
importddy = LBImportDDY(ddy_file=downloadepw.ddy_file)  # -> location, design_days; plug-in component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
analysisperiod = LBAnalysisPeriod(
    start_month=Slider(1, range=1..12),
    start_day=Slider(1, range=1..31),
    start_hour=Slider(8, range=0..23),
    end_month=Slider(12, range=1..12),
    end_day=Slider(31, range=1..31),
    end_hour=Slider(18, range=0..23))  # -> period, hoys, dates; plug-in component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
panel_12 = Panel(importddy.design_days)
applyper = LBApplyAnalysisPeriod(data=roomcomfortresult.air_temp, period=analysisperiod.period)  # -> data; plug-in component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
applyper_2 = LBApplyAnalysisPeriod(data=roomcomfortresult.rad_temp, period=analysisperiod.period)  # -> data; plug-in component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
applyper_3 = LBApplyAnalysisPeriod(data=roomcomfortresult.rel_humidity, period=analysisperiod.period)  # -> data; plug-in component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

# ----
# 选择计算时间段
number_slider_5 = Slider(1, range=1..31)
analysisperiod_2 = LBAnalysisPeriod(
    start_month=Slider(1, range=1..12),
    start_day=number_slider_5,
    start_hour=Slider(8, range=0..23),
    end_month=Slider(12, range=1..12),
    end_day=Slider(31, range=1..31),
    end_hour=Slider(18, range=0..23))  # -> period, hoys, dates; plug-in component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

clobytemp = LBClothingByTemperature(temperature=importepw.dry_bulb_temperature, period=analysisperiod.period, max_clo_temp=Slider(1, range=0..100))  # -> report, clo; plug-in component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
panel_13 = Panel(clobytemp.clo)
pmv = LBPMVComfort(
    air_temp=applyper,
    mrt=applyper_2,
    rel_humid=applyper_3,
    met_rate=Slider(1.2, range=0..10),
    clothing=clobytemp.clo,
    run=Toggle(False))  # -> report, pmv, ppd, set, comfort, condition, heat_loss, comf_obj; plug-in component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

# ---- group: 调整颜色显示间隔
颜色数量 = Panel("10")
legendpar = LBLegendParameters(seg_count=颜色数量)  # -> leg_par; plug-in component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

# ----
# PMV
pmvmap = HBPMVComfortMap(
    model=assigngridsviews_2,
    epw=downloadepw.epw_file,
    ddy=downloadepw.ddy_file,
    run_period=analysisperiod_2.period,
    clo_value=clobytemp.clo,
    run=Toggle(False))  # -> report, env_conds, temperature, condition, pmv, TCP, HSP, CSP; plug-in component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
data_3 = Data(gridrooms_2.mesh)

hourlyplot = LBHourlyPlot(data=pmv.condition, reverse_y=Toggle(True), clock_24=Slider(2, range=0..24), period=analysisperiod.period)  # -> report, mesh, legend, borders, labels, title, vis_set; plug-in component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
panel_14 = Panel(pmv.report)
panel_15 = Panel(pmvmap.pmv)
avr_2 = Average(Input=pmvmap.HSP)
neg_3 = Negative(Value=pmvmap.TCP)
avr_3 = Average(Input=pmvmap.CSP)
mjoin = MeshJoin(Meshes=hourlyplot.mesh)
avr_4 = Average(Input=neg_3)
panel_16 = Panel(avr_4)
全年平均热舒适温度时间占比 = Number(avr_4)
panel_17 = Panel(avr_2)
panel_18 = Panel(avr_3)
R_5 = RecordeData(Data=全年平均热舒适温度时间占比)

panel_19 = Panel("""0
10
11
22""")
number_slider_6 = Slider(21.8, range=0..100)
number_slider_7 = Slider(21.6, range=0..100)
colrange = LBColorRange(index=panel_19)  # -> colors; plug-in component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
legendpar_2 = LBLegendParameters(colors=colrange)  # -> leg_par; plug-in component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
bang_2 = ExplodeTree(Data=simplify(legendpar_2))  # -> Branch0, Branch1, Branch2, Branch3

thermalmtx = HBReadThermalMatrix(comf_result=pmvmap.temperature, load=Toggle(True))  # -> comf_mtx; plug-in component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
move = Move(Geometry=data_3, Motion="15,0,0")  # -> Geometry, Transform
vizthermalmap = HBVisualizeThermalMap(comf_mtx=thermalmtx, mesh=flatten(move.Geometry), legend_par=bang_2.Branch0)  # -> report, mesh, legend, title, colors, values; plug-in component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

division_5 = Division(A=R_5, B=100)
rev_3 = ReverseList(List=division_5)
panel_20 = Panel(rev_3)
clean_2 = CleanTree(RemoveNulls=True, RemoveInvalid=True, RemoveEmpty=False, Tree=R_5)
lng = ListLength(List=clean_2)
multiplication_2 = Multiplication(A=lng, B=Slider(20, range=0..100))
multiplication_3 = Multiplication(A=multiplication_2, B=-1)
trigger = Trigger(TestText=lng)  # disabled
Y = UnitY(Factor=multiplication_3)

panel_21 = Panel("""0
10
11
22""")
number_slider_8 = Slider(29, range=0..100)
number_slider_9 = Slider(40, range=0..100)
colrange_2 = LBColorRange(index=panel_21)  # -> colors; plug-in component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
legendpar_3 = LBLegendParameters(colors=colrange_2)  # -> leg_par; plug-in component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
bang_3 = ExplodeTree(Data=simplify(legendpar_3))  # -> Branch0, Branch1, Branch2, Branch3

mjoin_2 = MeshJoin(Meshes=vizthermalmap.mesh)

# ----
# 舒适时间占比
panel_22 = Panel("30,0,0")
move_2 = Move(Geometry=data_3, Motion=panel_22)  # -> Geometry, Transform
heatmap = LBSpatialHeatmap(values=pmvmap.TCP, mesh=move_2.Geometry, legend_par=bang_3.Branch3, legend_title="TCP%")  # -> mesh, legend, title, colors, legend_par; plug-in component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

button = Button()
mjoin_3 = MeshJoin(Meshes=heatmap.mesh)

panel_23 = Panel("""0
10
11
22""")
number_slider_10 = Slider(7, range=0..100)
number_slider_11 = Slider(23, range=0..100)
colrange_3 = LBColorRange(index=panel_23)  # -> colors; plug-in component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
legendpar_4 = LBLegendParameters(colors=colrange_3)  # -> leg_par; plug-in component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
bang_4 = ExplodeTree(Data=simplify(legendpar_4))  # -> Branch0, Branch1, Branch2, Branch3

# ----
# 过热时间占比
panel_24 = Panel("45,0,0")
move_3 = Move(Geometry=data_3, Motion=panel_24)  # -> Geometry, Transform
heatmap_2 = LBSpatialHeatmap(values=pmvmap.HSP, mesh=move_3.Geometry, legend_par=bang_4.Branch1, legend_title="HSP%")  # -> mesh, legend, title, colors, legend_par; plug-in component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

mjoin_4 = MeshJoin(Meshes=heatmap_2.mesh)

panel_25 = Panel("""0
10
11
22""")
number_slider_12 = Slider(47, range=0..100)
number_slider_13 = Slider(55, range=0..100)
colrange_4 = LBColorRange(index=panel_25)  # -> colors; plug-in component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
legendpar_5 = LBLegendParameters(colors=colrange_4)  # -> leg_par; plug-in component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
bang_5 = ExplodeTree(Data=simplify(legendpar_5))  # -> Branch0, Branch1, Branch2, Branch3

# ----
# 过冷时间占比
panel_26 = Panel("60,0,0")
move_4 = Move(Geometry=data_3, Motion=panel_26)  # -> Geometry, Transform
heatmap_3 = LBSpatialHeatmap(values=pmvmap.CSP, mesh=move_4.Geometry, legend_par=bang_5.Branch2, legend_title="CSP%")  # -> mesh, legend, title, colors, legend_par; plug-in component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

mjoin_5 = MeshJoin(Meshes=heatmap_3.mesh)
mesh = Mesh(flatten([mjoin_2, mjoin_3, mjoin_4, mjoin_5]))
move_5 = Move(Geometry=mesh, Motion=Y)  # -> Geometry, Transform
bake11 = Bake11(O=move_5.Geometry, bake=trigger)  # disabled

# ==== cluster Cluster
brep = ClusterInput()
brep_2 = Brep(graft(brep))
_0上1下 = ClusterInput()
brec = BoundingRectangle(Geometry=brep_2, Plane=PlaneXY(0, 0, 0), Axis=0, Slide=_0上1下, Union=True)
pcen = PolygonCenter(Polyline=brec)  # -> CenterV, CenterE, CenterA
scale = Scale(Geometry=brec, Center=pcen.CenterV, Factor="1.5")  # -> Geometry, Transform
bbx = BrepBrep(BrepA=brep_2, BrepB=scale.Geometry)  # -> Curves, Points
C = ClusterOutput(bbx.Curves)

# ==== cluster Cluster_3
课桌长度 = Panel("0.6")
课桌宽度 = Panel("0.4")
走廊间距 = ClusterInput()
前后间距 = ClusterInput()
座位排布范围_矩形 = ClusterInput()
视域排布范围 = ClusterInput()
deconstruct_brep = DeconstructBrep(Brep=座位排布范围_矩形)  # -> Faces, Edges, Vertices

multiplication = Multiplication(A=课桌长度, B="2")

list_item = ListItem(List=deconstruct_brep.Vertices, Index="0", Wrap=True)
rectangle = Rectangle(Plane=PlaneXY(0, 0, 0), XSize=课桌宽度, YSize=课桌长度, Radius=0)  # -> Rectangle, Length

addition = Addition(A=课桌长度, B=走廊间距)
series = Series(Start=0, Step=addition, Count="20")  # -> graft(Series)
curve = Curve(rectangle.Rectangle)
unit_y = UnitY(Factor=series)
move = Move(Geometry=curve, Motion=unit_y)  # -> graft(Geometry), Transform
series_2 = Series(Start=0, Step=前后间距, Count="20")
unit_x = UnitX(Factor=series_2)
教室排布_内置值 = Move(Geometry=move.Geometry, Motion=unit_x)  # -> flatten(Geometry), Transform

rectangle_2 = Rectangle(Plane=PlaneXY(0, 0, 0), XSize=课桌宽度, YSize=课桌长度, Radius=0)  # -> Rectangle, Length
unit_y_2 = UnitY(Factor=课桌长度)
move_2 = Move(Geometry=rectangle_2.Rectangle, Motion=unit_y_2)  # -> Geometry, Transform

addition_2 = Addition(A=multiplication, B=走廊间距)
series_3 = Series(Start=0, Step=addition_2, Count="20")  # -> graft(Series)
unit_y_3 = UnitY(Factor=series_3)
curve_2 = Curve([rectangle_2.Rectangle, move_2.Geometry])
move_3 = Move(Geometry=curve_2, Motion=unit_y_3)  # -> graft(Geometry), Transform
series_4 = Series(Start=0, Step=前后间距, Count="20")
unit_x_2 = UnitX(Factor=series_4)
教室排布_内置值_2 = Move(Geometry=move_3.Geometry, Motion=unit_x_2)  # -> flatten(Geometry), Transform

deconstruct_brep_2 = DeconstructBrep(Brep=rectangle_2.Rectangle)  # -> Faces, Edges, Vertices
deconstruct_brep_3 = DeconstructBrep(Brep=rectangle.Rectangle)  # -> Faces, Edges, Vertices
list_item_2 = ListItem(List=deconstruct_brep_2.Vertices, Index="0", Wrap=True)
list_item_3 = ListItem(List=deconstruct_brep_3.Vertices, Index="0", Wrap=True)
vector_2pt = Vector2Pt(PointA=list_item_3, PointB=list_item, Unitize=False)  # -> Vector, Length
vector_2pt_2 = Vector2Pt(PointA=list_item_2, PointB=list_item, Unitize=False)  # -> Vector, Length
move_4 = Move(Geometry=教室排布_内置值.Geometry, Motion=vector_2pt.Vector)  # -> Geometry, Transform
move_5 = Move(Geometry=教室排布_内置值_2.Geometry, Motion=vector_2pt_2.Vector)  # -> Geometry, Transform
x轴移动距离 = ClusterInput()
y轴移动距离 = ClusterInput()
negative = Negative(Value=x轴移动距离)
negative_2 = Negative(Value=y轴移动距离)
座位类型 = ClusterInput()
unit_x_3 = UnitX(Factor=negative)
unit_y_4 = UnitY(Factor=negative_2)
stream_filter = StreamFilter(Gate=座位类型, Stream0=move_4.Geometry, Stream1=move_5.Geometry)
move_6 = Move(Geometry=stream_filter, Motion=unit_x_3)  # -> Geometry, Transform
move_7 = Move(Geometry=move_6.Geometry, Motion=unit_y_4)  # -> Geometry, Transform
矩形范围 = ClusterInput()
curve_3 = Curve(move_7.Geometry)
deconstruct_brep_4 = DeconstructBrep(Brep=curve_3)  # -> Faces, Edges, Vertices
list_item_4 = ListItem(List=deconstruct_brep_4.Edges, Index="1", Wrap=True)  # -> flatten(Item)
curve_middle = CurveMiddle(Curve=list_item_4)
unit_x_4 = UnitX(Factor="0.1")
move_8 = Move(Geometry=curve_middle, Motion=unit_x_4)  # -> Geometry, Transform
point_in_curve = PointInCurve(Point=move_8.Geometry, Curve=座位排布范围_矩形)  # -> Relationship, Point
equality = Equality(FirstNumber=point_in_curve.Relationship, SecondNumber="0")  # -> Equality, Inequality
dispatch = Dispatch(List=curve_3, DispatchPattern=equality.Inequality)  # -> ListA, ListB
课桌 = Curve(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)
椅子 = Curve([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])
deconstruct_brep_5 = DeconstructBrep(Brep=课桌)  # -> Faces, Edges, Vertices
merge = Merge(Data1=课桌, Data2=椅子)
curve_4 = Curve(dispatch.ListA)
unit_x_5 = UnitX(Factor="0.1")
最佳视域 = ClusterInput()
deconstruct_brep_6 = DeconstructBrep(Brep=curve_4)  # -> Faces, Edges, Vertices
list_item_5 = ListItem(List=deconstruct_brep_6.Vertices, Index=0, Wrap=True)  # -> flatten(Item)
point_in_curve_2 = PointInCurve(Point=list_item_5, Curve=矩形范围)  # -> Relationship, Point
equality_2 = Equality(FirstNumber=point_in_curve_2.Relationship, SecondNumber="0")  # -> Equality, Inequality
dispatch_2 = Dispatch(List=curve_4, DispatchPattern=equality_2.Inequality)  # -> ListA, ListB
deconstruct_brep_7 = DeconstructBrep(Brep=dispatch_2.ListA)  # -> Faces, Edges, Vertices
list_item_6 = ListItem(List=deconstruct_brep_7.Vertices, Index=Slider(1, range=0..10), Wrap=True)  # -> flatten(Item)
point_in_curve_3 = PointInCurve(Point=list_item_6, Curve=矩形范围)  # -> Relationship, Point
equality_3 = Equality(FirstNumber=point_in_curve_3.Relationship, SecondNumber="0")  # -> Equality, Inequality
dispatch_3 = Dispatch(List=dispatch_2.ListA, DispatchPattern=equality_3.Inequality)  # -> ListA, ListB
deconstruct_brep_8 = DeconstructBrep(Brep=dispatch_3.ListA)  # -> Faces, Edges, Vertices
list_item_7 = ListItem(List=deconstruct_brep_8.Vertices, Index=Slider(2, range=0..10), Wrap=True)  # -> flatten(Item)
point_in_curve_4 = PointInCurve(Point=list_item_7, Curve=矩形范围)  # -> Relationship, Point
equality_4 = Equality(FirstNumber=point_in_curve_4.Relationship, SecondNumber="0")  # -> Equality, Inequality
dispatch_4 = Dispatch(List=dispatch_3.ListA, DispatchPattern=equality_4.Inequality)  # -> ListA, ListB
deconstruct_brep_9 = DeconstructBrep(Brep=dispatch_4.ListA)  # -> Faces, Edges, Vertices
list_item_8 = ListItem(List=deconstruct_brep_9.Vertices, Index=Slider(3, range=0..10), Wrap=True)  # -> flatten(Item)
point_in_curve_5 = PointInCurve(Point=list_item_8, Curve=矩形范围)  # -> Relationship, Point
equality_5 = Equality(FirstNumber=point_in_curve_5.Relationship, SecondNumber="0")  # -> Equality, Inequality
dispatch_5 = Dispatch(List=dispatch_4.ListA, DispatchPattern=equality_5.Inequality)  # -> ListA, ListB
panel = Panel(dispatch_2.ListA)
curve_5 = Curve(dispatch_5.ListA)
list_length = ListLength(List=curve_5)  # -> flatten(Length)
deconstruct_brep_10 = DeconstructBrep(Brep=curve_5)  # -> Faces, Edges, Vertices
座位个数 = ClusterOutput(list_length)
list_item_9 = ListItem(List=deconstruct_brep_10.Vertices, Index="0", Wrap=True)
list_item_10 = ListItem(List=deconstruct_brep_10.Edges, Index="1", Wrap=True)
curve_middle_2 = CurveMiddle(Curve=list_item_10)
curve_6 = Curve(最佳视域)
list_item_11 = ListItem(List=deconstruct_brep_5.Vertices, Index="3", Wrap=True)
move_9 = Move(Geometry=curve_middle_2, Motion=unit_x_5)  # -> Geometry, Transform
point_in_curve_6 = PointInCurve(Point=move_9.Geometry, Curve=最佳视域)  # -> Relationship, Point
equality_6 = Equality(FirstNumber=point_in_curve_6.Relationship, SecondNumber="0")  # -> flatten(Equality), flatten(Inequality)
vector_2pt_3 = Vector2Pt(PointA=list_item_11, PointB=list_item_9, Unitize=False)  # -> Vector, Length
move_10 = Move(Geometry=merge, Motion=vector_2pt_3.Vector)  # -> Geometry, Transform
dispatch_6 = Dispatch(List=curve_5, DispatchPattern=equality_6.Inequality)  # -> ListA, ListB
课桌椅 = ClusterOutput(move_10.Geometry)
curve_7 = Curve(dispatch_6.ListA)

# ---- group: 课桌定位点（3D）
课桌_2 = Brep([<brep referenced from the Rhino model> x36])
椅子_2 = Brep([<brep referenced from the Rhino model> x3])
课桌椅_2 = Brep([课桌_2, 椅子_2])

# ----
list_length_2 = ListLength(List=curve_7)
cluster = Cluster_2(课桌=课桌_2)
deconstruct_brep_11 = DeconstructBrep(Brep=curve_7)  # -> Faces, Edges, Vertices
最佳视域座位个数 = ClusterOutput(list_length_2)
vector_2pt_4 = Vector2Pt(PointA=cluster, PointB=list_item_9, Unitize=False)  # -> Vector, Length
list_item_12 = ListItem(List=deconstruct_brep_11.Vertices, Index="0", Wrap=True)
课桌_3 = Curve(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)
椅子_3 = Curve([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])
优质座位 = Move(Geometry=课桌椅_2, Motion=vector_2pt_4.Vector)  # -> Geometry, Transform
课桌高 = Panel("0.745")
deconstruct_brep_12 = DeconstructBrep(Brep=课桌_3)  # -> Faces, Edges, Vertices
merge_2 = Merge(Data1=课桌_3, Data2=椅子_3)
unit_z = UnitZ(Factor=课桌高)
move_11 = Move(Geometry=优质座位.Geometry, Motion=unit_z)  # -> Geometry, Transform
list_item_13 = ListItem(List=deconstruct_brep_12.Vertices, Index="3", Wrap=True)
vector_2pt_5 = Vector2Pt(PointA=list_item_13, PointB=list_item_12, Unitize=False)  # -> Vector, Length
课桌椅建模 = ClusterOutput(move_11.Geometry)
move_12 = Move(Geometry=merge_2, Motion=vector_2pt_5.Vector)  # -> Geometry, Transform
最佳视域座位 = ClusterOutput(move_12.Geometry)

# ==== cluster Bake11
O = ClusterInput()
group = Group(Objects=flatten(O))
bake = ClusterInput()
bake_2 = Bake(Object=group, Layer="默认", Bake=bake)

# ==== cluster Cluster_2
课桌 = ClusterInput()
deconstruct_brep = DeconstructBrep(Brep=课桌)  # -> Faces, Edges, flatten(Vertices)
point = Point(deconstruct_brep.Vertices)
pdecon = Deconstruct(Point=point)  # -> XComponent, YComponent, ZComponent
sort = SortList(Keys=pdecon.ZComponent)  # -> Keys, ValuesA
reverse_list = ReverseList(List=sort.Keys)
item = ListItem(List=reverse_list, Index=0, Wrap=True)
equals = Equality(FirstNumber=pdecon.ZComponent, SecondNumber=item)  # -> Equality, Inequality
dispatch = Dispatch(List=point, DispatchPattern=equals.Equality)  # -> ListA, ListB
point_2 = Point(dispatch.ListA)
pdecon_2 = Deconstruct(Point=point_2)  # -> XComponent, YComponent, ZComponent
sort_2 = SortList(Keys=pdecon_2.XComponent)  # -> Keys, ValuesA
item_2 = ListItem(List=sort_2.Keys, Index=0, Wrap=True)
equals_2 = Equality(FirstNumber=pdecon_2.XComponent, SecondNumber=item_2)  # -> Equality, Inequality
dispatch_2 = Dispatch(List=point_2, DispatchPattern=equals_2.Equality)  # -> ListA, ListB
point_3 = Point(dispatch_2.ListA)
pdecon_3 = Deconstruct(Point=point_3)  # -> XComponent, YComponent, ZComponent
sort_3 = SortList(Keys=pdecon_3.YComponent)  # -> Keys, ValuesA
item_3 = ListItem(List=sort_3.Keys, Index=0, Wrap=True)
equals_3 = Equality(FirstNumber=pdecon_3.YComponent, SecondNumber=item_3)  # -> Equality, Inequality
dispatch_3 = Dispatch(List=point_3, DispatchPattern=equals_3.Equality)  # -> ListA, ListB
定位点 = Point(dispatch_3.ListA)
定位点_2 = ClusterOutput(定位点)
