# Grasshopper definition 采光系数.gh (Grasshopper 1.0.7)
# plug-ins: Hare, Bifocals

教室层高 = Slider(3.5, range=0..10)
brep = Brep(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)
brep_2 = Brep(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)
# 教室
brep_3 = Brep(brep)
brep_4 = Brep(brep_3)
cluster = Cluster(brep=brep_4, _0上1下="0")
expression = Expression(x=教室层高, Expression="if(x>3.8,0.44,if(x<3.2,0.64,0.54))")
area = Area(Geometry=cluster)  # -> Area, Centroid
# 教室
brep_5 = Brep(brep_2)
multiplication = Multiplication(A=area.Area, B="0.2")
反射率 = Slider(0.75, range=0..1)
反射率_2 = Slider(0.4, range=0..1)
反射率_3 = Slider(0.75, range=0..1)
panel = Panel("https://energyplus-weather.s3.amazonaws.com/asia_wmo_region_2/CHN/CHN_Hubei.Wuhan.574940_SWERA/CHN_Hubei.Wuhan.574940_SWERA.zip")
窗墙比 = Slider(0.27, range=0.2..0.5)
panel_2 = Panel(multiplication)
反射率_4 = Slider(0.35, range=0..1)
opaquemod = HBOpaqueModifier(reflect=反射率_2)  # -> modifier; plug-in component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
opaquemod_2 = HBOpaqueModifier(reflect=反射率)  # -> modifier; plug-in component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
opaquemod_3 = HBOpaqueModifier(reflect=反射率_3)  # -> modifier; plug-in component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
number_slider = Slider(3, range=2..5)
opaquemod_4 = HBOpaqueModifier(reflect=反射率_4)  # -> modifier; plug-in component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
facparam = HBFacadeParameters(north=0, east=0, south=窗墙比, west=0)  # -> fac_par; plug-in component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
roomsolid = HBRoomFromSolid(geo=flatten(brep_3), conditioned=True)  # -> report, rooms; plug-in component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
downloadepw = LBDownloadWeather(weather_URL=panel)  # -> epw_file, stat_file, ddy_file; plug-in component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
facparam_2 = HBFacadeParameters(north=0, east=0, south=Slider(0.3, range=0..1), west=0)  # -> fac_par; plug-in component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
roomsolid_2 = HBRoomFromSolid(geo=flatten(brep_5), conditioned=True)  # -> report, rooms; plug-in component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
bldgvintages = HBBuildingVintages({"ASHRAE 90.1 2019  |  IECC 2021": "2019", "ASHRAE 90.1 2016  |  IECC 2018": "2016", "ASHRAE 90.1 2013  |  IECC 2015": "2013", "ASHRAE 90.1 2010  |  IECC 2012": "2010", "ASHRAE 90.1 2007  |  IECC 2009": "2007", "ASHRAE 90.1 2004  |  IECC 2006": "2004", "1980-2004 (CBECS)": "1980_2004", "Pre-1980 (CBECS)": "pre_1980"}, selected="ASHRAE 90.1 2019  |  IECC 2021")
exteriorsubset = HBExteriorModifierSubset(exterior_wall=opaquemod_3, exterior_roof=opaquemod_2, exposed_floor=opaquemod)  # -> exterior_set; plug-in component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
bldgprograms = HBBuildingPrograms({"LargeOffice", "MediumOffice", "SmallOffice", "MidriseApartment", "HighriseApartment", "Retail", "StripMall", "PrimarySchool", "SecondarySchool", "SmallHotel", "LargeHotel", "Hospital", "Outpatient", "Laboratory", "Warehouse", "SuperMarket", "FullServiceRestaurant", "QuickServiceRestaurant", "Courthouse", "College", "LargeDataCenterHighITE", "LargeDataCenterLowITE", "SmallDataCenterHighITE", "SmallDataCenterLowITE"}, selected="PrimarySchool")
toggle = BooleanToggle(True)
division = Division(A=Slider(9, range=0..10), B=number_slider)
exteriorsubset_2 = HBExteriorModifierSubset(exterior_wall=opaquemod_4)  # -> exterior_set; plug-in component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
bldgprograms_2 = HBBuildingPrograms({"LargeOffice", "MediumOffice", "SmallOffice", "MidriseApartment", "HighriseApartment", "Retail", "StripMall", "PrimarySchool", "SecondarySchool", "SmallHotel", "LargeHotel", "Hospital", "Outpatient", "Laboratory", "Warehouse", "SuperMarket", "FullServiceRestaurant", "QuickServiceRestaurant", "Courthouse", "College", "LargeDataCenterHighITE", "LargeDataCenterLowITE", "SmallDataCenterHighITE", "SmallDataCenterLowITE"}, selected="PrimarySchool")
toggle_2 = BooleanToggle(True)
aperturesbyratio = HBAperturesByRatio(hb_objs=roomsolid.rooms, ratio=facparam, sill_height=Slider(0.9, range=0..1), horiz_separ=division)  # -> out, hb_objs; plug-in component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
intsolid = HBIntersectSolids(rooms=flatten(brep_3), cpu_count=toggle, run=toggle)  # -> int_rooms; plug-in component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
aperturesbyratio_2 = HBAperturesByRatio(hb_objs=roomsolid_2.rooms, ratio=facparam_2)  # -> out, hb_objs; plug-in component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
modifierset = HBModifierSet(exterior_subset=exteriorsubset)  # -> mod_set; plug-in component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
galapagos = Galapagos(fitness=avr, gene=[number_slider, 窗墙比])
entwine = Entwine(Branch00=窗墙比, Branch01=number_slider, FlattenInputs=True)
brep_6 = Brep([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])
intsolid_2 = HBIntersectSolids(rooms=flatten(brep_5), cpu_count=toggle_2, run=toggle_2)  # -> int_rooms; plug-in component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
searchprog = HBSearchPrograms(bldg_prog=bldgprograms, vintage=bldgvintages)  # -> room_prog; plug-in component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
modifierset_2 = HBModifierSet(exterior_subset=exteriorsubset_2)  # -> mod_set; plug-in component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
door = HBDoor(geo=brep_6)  # -> report, doors; plug-in component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
R = RecordeData(Data=entwine)
facesbytype = HBFacesByType(hb_objs=aperturesbyratio.hb_objs)  # -> walls, interior_walls, roofs, ceilings, exterior_floors, interior_floors, air_walls, apertures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; plug-in component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
searchprog_2 = HBSearchPrograms(bldg_prog=bldgprograms_2)  # -> room_prog; plug-in component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
facesbytype_2 = HBFacesByType(hb_objs=aperturesbyratio_2.hb_objs)  # -> walls, interior_walls, roofs, ceilings, exterior_floors, interior_floors, air_walls, apertures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; plug-in component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
clean = CleanTree(RemoveNulls=True, RemoveInvalid=True, RemoveEmpty=False, Tree=R)
roomsolid_3 = HBRoomFromSolid(geo=flatten(intsolid), mod_set=modifierset, program=searchprog, conditioned=True)  # -> report, rooms; plug-in component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
bang = ExplodeTree(Data=clean)  # -> Branch0, Branch1
vizwiref = HBVizualizeWireframe(hb_objs=flatten(facesbytype.apertures))  # -> geo; plug-in component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
roomsolid_4 = HBRoomFromSolid(geo=flatten(intsolid_2), mod_set=modifierset_2, program=searchprog_2, conditioned=True)  # -> report, rooms; plug-in component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
area_2 = Area(Geometry=vizwiref)  # -> Area, Centroid
glassmod = HBGlassModifier(trans=Slider(0.65, range=0..1))  # -> modifier; plug-in component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
vizwiref_2 = HBVizualizeWireframe(hb_objs=flatten(facesbytype_2.apertures))  # -> geo; plug-in component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
panel_3 = Panel(bang.Branch1)
glassmod_2 = HBGlassModifier(trans=Slider(0.66, range=0..1))  # -> modifier; plug-in component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
ma = MassAddition(Input=area_2.Area)  # -> Result, PartialResults
boundary = BoundarySurfaces(Edges=vizwiref)
solveadj = HBSolveAdjacency(rooms=flatten(roomsolid_3.rooms), run=toggle)  # -> report, adj_rooms; plug-in component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
division_2 = Division(A=ma.Result, B=窗墙比)
division_3 = Division(A=multiplication, B=division_2)
boundary_2 = BoundarySurfaces(Edges=vizwiref_2)
solveadj_2 = HBSolveAdjacency(rooms=flatten(roomsolid_4.rooms), run=toggle_2)  # -> report, adj_rooms; plug-in component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
panel_4 = Panel(boundary)
aperture = HBAperture(geo=boundary, rad_mod=glassmod)  # -> report, apertures; plug-in component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
facesbytype_3 = HBFacesByType(hb_objs=roomsolid_3.rooms)  # -> walls, interior_walls, roofs, ceilings, exterior_floors, interior_floors, air_walls, apertures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; plug-in component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
aperture_2 = HBAperture(geo=boundary_2, rad_mod=glassmod_2)  # -> report, apertures; plug-in component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
facesbytype_4 = HBFacesByType(hb_objs=roomsolid_4.rooms)  # -> walls, interior_walls, roofs, ceilings, exterior_floors, interior_floors, air_walls, apertures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; plug-in component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
addsubface = HBAddSubface(hb_obj=flatten(solveadj.adj_rooms), sub_faces=flatten(aperture.apertures))  # -> hb_obj; plug-in component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
addsubface_2 = HBAddSubface(hb_obj=flatten(solveadj_2.adj_rooms), sub_faces=flatten([aperture_2.apertures, door.doors]))  # -> hb_obj; plug-in component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
vizwiref_3 = HBVizualizeWireframe(hb_objs=flatten(facesbytype_3.walls))  # -> geo; plug-in component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
model = HBModel(rooms=flatten(addsubface))  # -> report, model; plug-in component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
vizwiref_4 = HBVizualizeWireframe(hb_objs=flatten(facesbytype_4.walls))  # -> geo; plug-in component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
model_2 = HBModel(rooms=flatten(addsubface_2))  # -> report, model; plug-in component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
explode = Explode(Curve=vizwiref_3, Recursive=True)  # -> flatten(Segments), Vertices
explode_2 = Explode(Curve=vizwiref_4, Recursive=True)  # -> flatten(Segments), Vertices
len = Length(Curve=explode.Segments)
len_2 = Length(Curve=explode_2.Segments)
sort = SortList(Keys=len)  # -> Keys, ValuesA
sort_2 = SortList(Keys=len_2)  # -> Keys, ValuesA
item = ListItem(List=sort.Keys, Index="-1", Wrap=True)
gridrooms = HBSensorGridFromRooms(rooms=addsubface, grid_size=Slider(0.5, range=0..1), dist_floor=Slider(0.8, range=0..1))  # -> grid, points, mesh; plug-in component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
item_2 = ListItem(List=sort_2.Keys, Index="-1", Wrap=True)
gridrooms_2 = HBSensorGridFromRooms(rooms=addsubface_2, grid_size=Slider(0.6, range=0..1), dist_floor=Slider(0.7, range=0..1))  # -> grid, points, mesh; plug-in component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
multiplication_2 = Multiplication(A=item, B="1.5")
multiplication_3 = Multiplication(A=item_2, B="1.5")
assigngridsviews = HBAssignGridsAndViews(model=model.model, grids=flatten(gridrooms.grid))  # -> model; plug-in component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
wea = HBWeaFromEPW(epw_file=downloadepw.epw_file)  # -> wea; plug-in component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
assigngridsviews_2 = HBAssignGridsAndViews(model=model_2.model, grids=flatten(gridrooms_2.grid))  # -> model; plug-in component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
wea_2 = HBWeaFromEPW(epw_file=downloadepw.epw_file)  # -> wea; plug-in component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
照度 = Panel("-lt 450 -ut 2000")
照度_2 = Panel("-lt 300 -ut 1000")
annualdaylight = HBAnnualDaylight(model=assigngridsviews, wea=wea, thresholds=照度, run=Toggle(False))  # -> report, results, DA, cDA, UDI, UDI_low, UDI_up; plug-in component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
# DF（采光系数）
daylightfactor = HBDaylightFactor(model=assigngridsviews, run=Toggle(False))  # -> report, results; plug-in component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
annualdaylight_2 = HBAnnualDaylight(model=assigngridsviews_2, wea=wea_2, thresholds=照度_2, run=Toggle(False))  # -> report, results, DA, cDA, UDI, UDI_low, UDI_up; plug-in component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
# DF（采光系数）
daylightfactor_2 = HBDaylightFactor(model=assigngridsviews_2, run=Toggle(False))  # -> report, results; plug-in component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
panel_5 = Panel("""2
3
2
2
3
3
5
5
3
2
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""")
mjoin = MeshJoin(Meshes=gridrooms.mesh)
avr = Average(Input=annualdaylight.UDI)
avr_2 = Average(Input=annualdaylight_2.UDI)
mjoin_2 = MeshJoin(Meshes=gridrooms_2.mesh)
larger = LargerThan(FirstNumber=annualdaylight.UDI, SecondNumber=25)  # -> LargerThan, OrEqualTo
rev = ReverseList(List=panel_5)
R_2 = RecordeData(Data=avr)
dispatch = Dispatch(List=annualdaylight.UDI, DispatchPattern=larger.OrEqualTo)  # -> ListA, ListB
larger_2 = LargerThan(FirstNumber=annualdaylight_2.UDI, SecondNumber=25)  # -> LargerThan, OrEqualTo
panel_6 = Panel(rev)
panel_7 = Panel(avr_2)
clean_2 = CleanTree(RemoveNulls=True, RemoveInvalid=True, RemoveEmpty=False, Tree=R_2)
panel_8 = Panel(clean_2)
lng = ListLength(List=dispatch.ListA)
lng_2 = ListLength(List=annualdaylight.UDI)
dispatch_2 = Dispatch(List=annualdaylight_2.UDI, DispatchPattern=larger_2.OrEqualTo)  # -> ListA, ListB
lng_3 = ListLength(List=clean_2)
multiplication_4 = Multiplication(A=lng_3, B=multiplication_2)
division_4 = Division(A=lng, B=lng_2)
lng_4 = ListLength(List=annualdaylight_2.UDI)
lng_5 = ListLength(List=dispatch_2.ListA)
multiplication_5 = Multiplication(A=multiplication_4, B=-1)
division_5 = Division(A=lng_5, B=lng_4)
data = Data(flatten(annualdaylight_2.UDI))
Y = UnitY(Factor=multiplication_5)
X = UnitX(Factor=multiplication_2)
panel_10 = Panel(division_5)
move = Move(Geometry=mjoin, Motion=Y)  # -> Geometry, Transform
heatmap = LBSpatialHeatmap(values=data, mesh=mjoin_2)  # -> mesh, legend, title, colors, legend_par, vis_set; plug-in component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
move_2 = Move(Geometry=move.Geometry, Motion=X)  # -> Geometry, Transform
trigger = Trigger(TestText=lng_3)  # disabled
data_2 = Data(flatten(annualdaylight.UDI))
data_3 = Data(flatten(annualdaylight.DA))
heatmap_2 = LBSpatialHeatmap(values=data_2, mesh=move.Geometry)  # -> mesh, legend, title, colors, legend_par, vis_set; plug-in component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
heatmap_3 = LBSpatialHeatmap(values=data_3, mesh=move_2.Geometry)  # -> mesh, legend, title, colors, legend_par, vis_set; plug-in component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
bake11 = Bake11(O=[heatmap_2.mesh, heatmap_2.legend, heatmap_3.mesh, heatmap_3.legend], bake=trigger)  # disabled

# ==== cluster Bake11
O = ClusterInput()
group = Group(Objects=flatten(O))
bake = ClusterInput()
bake_2 = Bake(Object=group, Layer="默认", Bake=bake)

# ==== cluster Cluster
brep = ClusterInput()
brep_2 = Brep(graft(brep))
_0上1下 = ClusterInput()
brec = BoundingRectangle(Geometry=brep_2, Plane=PlaneXY(0, 0, 0), Axis=0, Slide=_0上1下, Union=True)
pcen = PolygonCenter(Polyline=brec)  # -> CenterV, CenterE, CenterA
scale = Scale(Geometry=brec, Center=pcen.CenterV, Factor="1.5")  # -> Geometry, Transform
bbx = BrepBrep(BrepA=brep_2, BrepB=scale.Geometry)  # -> Curves, Points
C = ClusterOutput(bbx.Curves)
