# Grasshopper definition 日照分析.gh (Grasshopper 1.0.7)
# plug-ins: Hare, LadybugGrasshopper, Pufferfish

panel = Panel("https://energyplus-weather.s3.amazonaws.com/asia_wmo_region_2/CHN/CHN_Hubei.Wuhan.574940_SWERA/CHN_Hubei.Wuhan.574940_SWERA.zip")
brep = Brep([<brep referenced from the Rhino model> x52])
月份 = Slider(12, range=1..12)
小时 = Slider(9, range=0..23)
小时_2 = Slider(15, range=0..23)
时间步_每个小时分成几份 = Slider(4, range=0..10)
日期 = Slider(21, range=1..31)
brep_2 = Brep([<brep referenced from the Rhino model> x9])
brep_3 = Brep([<brep referenced from the Rhino model> x43])
brep_4 = Brep([<brep referenced from the Rhino model> x43])
brep_5 = Brep([<brep referenced from the Rhino model> x9])
facparam = HBFacadeParameters(north=0, east=0, south=Slider(0.3, range=0..1), west=0)  # -> fac_par; plug-in component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
facparam_2 = HBFacadeParameters(north=Slider(0.3, range=0..1), east=0, south=0, west=0)  # -> fac_par; plug-in component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
downloadepw = LBDownloadWeather(weather_URL=panel)  # -> epw_file, stat_file, ddy_file; plug-in component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
roomsolid = HBRoomFromSolid(geo=flatten(brep_3), conditioned=True)  # -> report, rooms; plug-in component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
roomsolid_2 = HBRoomFromSolid(geo=flatten(brep_5), conditioned=True)  # -> report, rooms; plug-in component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
geo = Geometry([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])
aperturesbyratio = HBAperturesByRatio(hb_objs=roomsolid.rooms, ratio=facparam)  # -> out, hb_objs; plug-in component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
analysisperiod = LBAnalysisPeriod(start_month=月份, start_day=日期, start_hour=小时, end_month=月份, end_day=日期, end_hour=小时_2, timestep=时间步_每个小时分成几份)  # -> period, hoys, dates; plug-in component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
aperturesbyratio_2 = HBAperturesByRatio(hb_objs=roomsolid_2.rooms, ratio=facparam_2)  # -> out, hb_objs; plug-in component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
importloc = LBImportLocation(epw_file=downloadepw.epw_file)  # -> location; plug-in component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
brec = BoundingRectangle(Geometry=geo, Plane=PlaneXY(0, 0, 0), Axis=0, Slide=0, Union=True)
area = Area(Geometry=brec)  # -> expr("x/30000", Area), Centroid
facesbytype = HBFacesByType(hb_objs=aperturesbyratio.hb_objs)  # -> walls, interior_walls, roofs, ceilings, exterior_floors, interior_floors, air_walls, apertures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; plug-in component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
facesbytype_2 = HBFacesByType(hb_objs=aperturesbyratio_2.hb_objs)  # -> walls, interior_walls, roofs, ceilings, exterior_floors, interior_floors, air_walls, apertures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; plug-in component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
scale = Scale(Geometry=brec, Center=area.Centroid, Factor=Slider(1.25, range=0..10))  # -> Geometry, Transform
brep_6 = Brep([<brep referenced from the Rhino model> x136])
roomsolid_3 = HBRoomFromSolid(geo=flatten(brep_6), conditioned=True)  # -> report, rooms; plug-in component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
boundary = BoundarySurfaces(Edges=scale.Geometry)
sunpath = LBSunPath(location=importloc, hoys=analysisperiod.hoys, center_pt=area.Centroid, scale=area.Area)  # -> report, vectors, altitudes, azimuths, hoys, sun_pts, analemma, daily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; plug-in component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
vizwiref = HBVizualizeWireframe(hb_objs=flatten([facesbytype.roofs, facesbytype.walls, facesbytype_2.walls, facesbytype_2.roofs]))  # -> geo; plug-in component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
facesbytype_3 = HBFacesByType(hb_objs=roomsolid_3.rooms)  # -> walls, interior_walls, roofs, ceilings, exterior_floors, interior_floors, air_walls, apertures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; plug-in component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
viznorm = HBVizualizeNormals(hb_objs=facesbytype.apertures)  # -> points, vectors; plug-in component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
vizwiref_2 = HBVizualizeWireframe(hb_objs=[facesbytype.apertures, facesbytype_2.apertures])  # -> geo; plug-in component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
boundary_2 = BoundarySurfaces(Edges=vizwiref)
boundary_3 = BoundarySurfaces(Edges=vizwiref_2)
geo_2 = Geometry([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])
vizwiref_3 = HBVizualizeWireframe(hb_objs=flatten([facesbytype_3.walls, facesbytype_3.roofs]))  # -> geo; plug-in component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
boundary_4 = BoundarySurfaces(Edges=geo_2)
分析网格密度 = Panel("1")
falsestart = LBFalseStartToggle(False)
boundary_surfaces = BoundarySurfaces(Edges=vizwiref_3)
legendpar = LBLegendParameters(min=Slider(0, range=0..100), max=Slider(6, range=0..10), seg_count=Slider(7, range=0..10))  # -> leg_par; plug-in component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
directsunhours = LBDirectSunHours(
    vectors=flatten(sunpath.vectors),
    timestep=时间步_每个小时分成几份,
    geometry=flatten(boundary_3),
    context=flatten([boundary_2, boundary_surfaces]),
    grid_size=分析网格密度,
    cpu_count=falsestart,
    run=falsestart)  # -> report, points, results, mesh, legend, title, int_mtx; plug-in component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
falsestart_2 = LBFalseStartToggle(False)
mesh = Mesh(directsunhours.mesh)
directsunhours_2 = LBDirectSunHours(
    vectors=flatten(sunpath.vectors),
    timestep=时间步_每个小时分成几份,
    geometry=flatten(boundary),
    context=flatten(boundary_surfaces),
    grid_size=分析网格密度,
    offset_dist=Slider(5.7, range=0..10),
    legend_par=legendpar,
    cpu_count=falsestart_2,
    run=falsestart_2)  # -> report, points, results, mesh, legend, title, int_mtx; plug-in component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
mesh_2 = Mesh(directsunhours_2.mesh)
panel_2 = Panel("30 to -30")  # disabled
number_slider = Slider(6, range=0..10)  # disabled
rectangle = Rectangle(Plane=PlaneXY(0, 0, 0), XSize=panel_2, YSize=panel_2, Radius=0)  # -> Rectangle, Length; disabled
area_2 = Area(Geometry=rectangle.Rectangle)  # -> Area, Centroid; disabled
populate_2d = Populate2D(Region=rectangle.Rectangle, Count=number_slider, Seed=1)  # disabled
panel_3 = Panel("13 to -13")  # disabled
panel_4 = Panel("3 to -3")  # disabled
panel_5 = Panel("0 to 4")  # disabled
number_slider_2 = Slider(2, range=0..10)  # disabled
domain_box = DomainBox(Base=populate_2d, X=panel_3, Y=panel_4, Z=panel_5)  # disabled
number_slider_3 = Slider(4, range=0..10)  # disabled
number_slider_4 = Slider(5, range=0..10)  # disabled
number_slider_5 = Slider(0.35, range=0..1)  # disabled
scale_2 = Scale(Geometry=rectangle.Rectangle, Center=area_2.Centroid, Factor=number_slider_2)  # -> Geometry, Transform; disabled
series = Series(Start=0, Step=number_slider_3, Count=number_slider_4)  # disabled
roomsolid_4 = HBRoomFromSolid(geo=flatten(domain_box), conditioned=True)  # -> out, rooms; disabled; plug-in component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
unit_z = UnitZ(Factor=series)  # disabled
facparam_3 = HBFacadeParameters(north=0, east=0, south=number_slider_5, west=0)  # -> fac_par; disabled; plug-in component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
move = HBMove(hb_objs=flatten(roomsolid_4.rooms), vector=unit_z)  # -> hb_objs; disabled; plug-in component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
aperturesbyratio_3 = HBAperturesByRatio(hb_objs=move, ratio=facparam_3)  # -> out, hb_objs; disabled; plug-in component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
panel_6 = Panel("https://energyplus-weather.s3.amazonaws.com/asia_wmo_region_2/CHN/CHN_Shanghai.Shanghai.583620_CSWD/CHN_Shanghai.Shanghai.583620_CSWD.zip")  # disabled
facesbytype_4 = HBFacesByType(hb_objs=aperturesbyratio_3.hb_objs)  # -> walls, interior_walls, roofs, ceilings, exterior_floors, interior_floors, air_walls, apertures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; disabled; plug-in component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
downloadepw_2 = LBDownloadWeather(weather_URL=panel_6)  # -> epw_file, stat_file, ddy_file; disabled; plug-in component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
vizwiref_4 = HBVizualizeWireframe(hb_objs=flatten([facesbytype_4.walls, facesbytype_4.roofs]))  # -> geo; disabled; plug-in component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

deconstruct_brep = DeconstructBrep()  # -> Faces, Edges, Vertices
curve = Curve(deconstruct_brep.Edges)
length = Length(Curve=curve)
max_min = MaxMin(Numbers=length)  # -> Max, MaxIndex, Min, MinIndex
rectangle_2 = Rectangle(Plane=PlaneXY(0, 0, 0), XSize=max_min.Max, YSize=max_min.Max, Radius=0)  # -> Rectangle, Length
polygon_center = PolygonCenter(Polyline=rectangle_2.Rectangle)  # -> CenterV, CenterE, CenterA
polygon_center_2 = PolygonCenter()  # -> CenterV, CenterE, CenterA
point = Point(polygon_center_2.CenterE)
point_2 = Point(polygon_center.CenterE)
vector_2pt = Vector2Pt(PointA=point_2, PointB=point, Unitize=False)  # -> Vector, Length
move_2 = Move(Geometry=rectangle_2.Rectangle, Motion=vector_2pt.Vector)  # -> Geometry, Transform
scale_3 = Scale(Geometry=move_2.Geometry, Center=point, Factor=Slider(2, range=0..10))  # -> Geometry, Transform
boundary_surfaces_2 = BoundarySurfaces(Edges=scale_3.Geometry)

viznorm_2 = HBVizualizeNormals(hb_objs=facesbytype_4.apertures)  # -> points, vectors; disabled; plug-in component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
vizwiref_5 = HBVizualizeWireframe(hb_objs=facesbytype_4.apertures)  # -> geo; disabled; plug-in component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

月份_2 = Slider(1, range=1..12)
日期_2 = Slider(21, range=1..31)
小时_3 = Slider(8, range=0..23)
小时_4 = Slider(16, range=0..23)
时间步_每个小时分成几份_2 = Slider(2, range=0..10)
analysisperiod_2 = LBAnalysisPeriod(start_month=月份_2, start_day=日期_2, start_hour=小时_3, end_month=月份_2, end_day=日期_2, end_hour=小时_4, timestep=时间步_每个小时分成几份_2)  # -> period, hoys, dates; plug-in component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

importepw = LBImportEPW(epw_file=downloadepw_2.epw_file)  # -> location, dry_bulb_temperature, dew_point_temperature, relative_humidity, wind_speed, wind_direction, direct_normal_rad, diffuse_horizontal_rad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; disabled; plug-in component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
boundary_surfaces_3 = BoundarySurfaces(Edges=vizwiref_4)  # disabled
boundary_surfaces_4 = BoundarySurfaces(Edges=vizwiref_5)  # disabled
number_slider_6 = Slider(12, range=0..100)  # disabled
number_slider_7 = Slider(21, range=0..100)  # disabled
number_slider_8 = Slider(8, range=0..10)  # disabled
number_slider_9 = Slider(16, range=0..100)  # disabled
number_slider_10 = Slider(9, range=0..10)  # disabled
number_slider_11 = Slider(0, range=0..100)  # disabled
number_slider_12 = Slider(10, range=0..10)  # disabled

sunpath_2 = LBSunPath(hoys=analysisperiod_2.hoys, scale=1)  # -> out, vectors, altitudes, azimuths, hoys, sun_pts, analemma, daily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; plug-in component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
太阳半径 = Slider(5, range=0..10)
sphere = Sphere(Base=sunpath_2.sun_pts, Radius=太阳半径)
custom_preview = CustomPreview(Geometry=sphere, Material=ColourSwatch(SwatchColor=RGB(255, 224, 66)))

is_planar = IsPlanar(Surface=boundary_surfaces_4, Interior=True)  # -> Planar, Plane; disabled
analysisperiod_3 = LBAnalysisPeriod(
    start_month=number_slider_6,
    start_day=number_slider_7,
    start_hour=number_slider_8,
    end_month=number_slider_6,
    end_day=number_slider_7,
    end_hour=number_slider_9)  # -> period, hoys, dates; disabled; plug-in component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
legendpar_2 = LBLegendParameters(min=number_slider_11, max=number_slider_10, seg_count=number_slider_12)  # -> leg_par; disabled; plug-in component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
sunpath_3 = LBSunPath(location=importepw.location, hoys=analysisperiod_3.hoys, scale=1)  # -> out, vectors, altitudes, azimuths, hoys, sun_pts, analemma, daily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; disabled; plug-in component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
boundary_surfaces_5 = BoundarySurfaces(Edges=scale_2.Geometry)  # -> flatten(Surfaces); disabled
number_slider_13 = Slider(12, range=0..100)  # disabled
number_slider_14 = Slider(1, range=0..10)  # disabled
number_slider_15 = Slider(1, range=0..10)  # disabled
number_slider_16 = Slider(0.1, range=0..0.1)  # disabled
boolean_toggle = BooleanToggle(True)  # disabled
boolean_toggle_2 = BooleanToggle(True)  # disabled
directsunhours_3 = LBDirectSunHours(
    vectors=flatten(sunpath_3.vectors),
    geometry=boundary_surfaces_5,
    context=flatten(boundary_surfaces_3),
    grid_size=number_slider_14,
    offset_dist=number_slider_13,
    legend_par=legendpar_2,
    cpu_count=boolean_toggle,
    run=boolean_toggle)  # -> out, points, results, mesh, legend, title, int_mtx; disabled; plug-in component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
directsunhours_4 = LBDirectSunHours(
    vectors=flatten(sunpath_3.vectors),
    geometry=flatten(boundary_surfaces_4),
    context=flatten(boundary_surfaces_3),
    grid_size=number_slider_15,
    offset_dist=number_slider_16,
    legend_par=legendpar_2,
    cpu_count=boolean_toggle_2,
    run=boolean_toggle_2)  # -> out, points, results, mesh, legend, title, int_mtx; disabled; plug-in component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
list_length = ListLength(List=flatten(boundary_surfaces_4))  # disabled
list_length_2 = ListLength(List=directsunhours_4.results)  # disabled
mesh_3 = Mesh(directsunhours_4.mesh)  # disabled
division = Division(A=list_length_2, B=list_length)  # disabled
partition_list = PartitionList(List=directsunhours_4.results, Size=division)  # disabled
sort_list = SortList(Keys=partition_list)  # -> Keys, ValuesValuesA; disabled
average = Average(Input=partition_list)  # -> flatten(ArithmeticMean); disabled
list_item = ListItem(List=sort_list.Keys, Index=0, Wrap=True)  # -> flatten(Item); disabled
text_tag_3d = TextTag3D(Location=flatten(is_planar.Plane), Text=list_item, Size=1, Justification=8)  # disabled

# ---- group: 调整颜色显示间隔
最小值 = Panel("0")
颜色数量 = Panel("10")
最大值 = Panel("9")
legendpar_3 = LBLegendParameters(min=最小值, max=最大值, seg_count=颜色数量)  # -> leg_par; plug-in component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

# ----
分析网格密度_2 = Panel("2")

# ----
# 日照时数
facesbytype_5 = HBFacesByType()  # -> walls, interior_walls, roofs, ceilings, exterior_floors, interior_floors, air_walls, apertures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; plug-in component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
vizall = HBVisualizeAll(hb_objs=flatten(facesbytype_5.roofs))  # -> geo; plug-in component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
vizall_2 = HBVisualizeAll(hb_objs=flatten(facesbytype_5.apertures))  # -> geo; plug-in component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
vizall_3 = HBVisualizeAll(hb_objs=flatten(facesbytype_5.walls))  # -> geo; plug-in component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
lb_falsestarttoggle = LBFalseStartToggle(False)
分析网格密度_3 = Panel("0.5")

area_3 = Area(Geometry=vizall_2)  # -> Area, Centroid

larger_than = LargerThan(FirstNumber=area_3.Area, SecondNumber=Slider(0.5, range=0..1))  # -> LargerThan, OrEqualTo
dispatch = Dispatch(List=vizall_2, DispatchPattern=larger_than.LargerThan)  # -> ListA, ListB

directsunhours_5 = LBDirectSunHours(
    vectors=flatten(sunpath_2.vectors),
    timestep=时间步_每个小时分成几份_2,
    geometry=flatten(boundary_surfaces_2),
    context=flatten(dispatch.ListA),
    grid_size=分析网格密度_3,
    cpu_count=lb_falsestarttoggle,
    run=lb_falsestarttoggle)  # -> out, points, results, mesh, legend, title, int_mtx; plug-in component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

is_planar_2 = IsPlanar(Surface=dispatch.ListA, Interior=True)  # -> Planar, Plane
directsunhours_6 = LBDirectSunHours(
    vectors=flatten(sunpath_2.vectors),
    timestep=时间步_每个小时分成几份_2,
    geometry=flatten(dispatch.ListA),
    context=flatten([vizall, vizall_3]),
    grid_size=分析网格密度_2,
    legend_par=legendpar_3,
    cpu_count=lb_falsestarttoggle,
    run=lb_falsestarttoggle)  # -> out, points, results, mesh, legend, title, int_mtx; plug-in component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
text_tag_3d_2 = TextTag3D(Location=is_planar_2.Plane, Text=directsunhours_6.results, Size=Slider(0.3, range=0..1), Justification=5)
