# Grasshopper definition zq.gh (Grasshopper 1.0.7)
# plug-ins: Human

rectangle = Rectangle(Plane=PlaneXY(0, 0, 0), XSize="100", YSize="100", Radius=0)  # -> Rectangle, Length
crv = Curve(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)
pop2d = Populate2D(Region=rectangle.Rectangle, Count=Slider(9000, range=0..10000), Seed=1)
orient = Orient(Geometry=crv, Source=PlaneXY(0, 0, 0), Target=pop2d)  # -> Geometry, Transform
image = ImageSampler(
    pop2d,
    FilePath="E:\临时用\B230307017 张奇\GqzUpZsbAAAZf7d.jpg",
    Filter="Value",
    Interpolate=False,
    Umax=100,
    Umin=0,
    Vmax=100,
    Vmin=0,
    Wrap=1)
number_slider = Slider(20, range=0..100)
pi = Pi(Factor=Slider(0.5, range=0..1))
dom = ConstructDomain(DomainStart=expr("-x", pi), DomainEnd=pi)
dom_2 = ConstructDomain(DomainStart=expr("-x", number_slider), DomainEnd=number_slider)
dom_3 = ConstructDomain(DomainStart=Slider(2, range=0..10), DomainEnd=Slider(1, range=0..10))
dom_4 = ConstructDomain(DomainStart=Slider(1, range=0..1), DomainEnd=Slider(0.4, range=0..1))
bnd = Bounds(Numbers=image)
remap = RemapNumbers(Value=image, Source=bnd, Target=dom_4)  # -> Mapped, Clipped
remap_2 = RemapNumbers(Value=image, Source=bnd, Target=dom)  # -> Mapped, Clipped
remap_3 = RemapNumbers(Value=image, Source=bnd, Target=Domain(0, 1))  # -> Mapped, Clipped
remap_4 = RemapNumbers(Value=image, Source=bnd, Target=dom_3)  # -> Mapped, Clipped
remap_5 = RemapNumbers(Value=image, Source=bnd, Target=dom_2)  # -> Mapped, Clipped
scale = Scale(Geometry=orient.Geometry, Center=pop2d, Factor=remap.Mapped)  # -> Geometry, Transform
Z = UnitZ(Factor=remap_5.Mapped)
move = Move(Geometry=scale.Geometry, Motion=Z)  # -> Geometry, Transform
scale_nu = ScaleNU(Geometry=move.Geometry, Plane=pop2d, ScaleX=1, ScaleY=remap_4.Mapped, ScaleZ=1)  # -> Geometry, Transform
gradient = Gradient(
    LowerLimit=0,
    UpperLimit=1,
    Parameter=remap_3.Mapped,
    stops=[0: RGB(10, 53, 105), 0.556: RGB(227, 123, 54), 1: RGB(234, 247, 173)])
rotate = Rotate(Geometry=scale_nu.Geometry, Angle=remap_2.Mapped, Plane=pop2d)  # -> Geometry, Transform
boundary = BoundarySurfaces(Edges=graft(rotate.Geometry))  # -> flatten(Surfaces)
mesh = MeshBrep(
    Brep=boundary,
    Settings={GridMaxCount=0, GridMinCount=16, JaggedSeams=False, MaxEdgeLength=0, MinEdgeLength=0.0001, MinTolerance=0, Refine=True, RefineAngle=0, RelativeTolerance=0.65, SimplePlanes=True, Tolerance=0})
material = CreateMaterial(Diffuse=gradient, Specular=gradient, Emission=gradient, Transparency=0, Shine=0)
previewlw = CustomPreviewLineweights(Geometry=rotate.Geometry, Shader=ColourSwatch(SwatchColor=RGB(0, 149, 255)), Absolute=False)
preview = CustomPreview(Geometry=mesh, Material=material)
