# Grasshopper definition zuoye.gh (Grasshopper 1.0.8)

number_slider = Slider(100, range=-101.001..100)
surface = Surface(<surface referenced from the Rhino model>)
python_3_script = Python3Script(
    x=Slider(20, range=0..20),
    y=number_slider,
    z=Slider(50, range=-999999.001..50),
    a=Slider(10, range=0..10),
    b=Slider(0.25, range=0..5))  # -> out, a, flatten(b), flatten(c); inputs c: Boolean
# ---------- python_3_script: Python ----------
# 导入所需的库
import rhinoscriptsyntax as rs
import scriptcontext as sc
import Rhino.Geometry as rg

# 初始化输出变量
base_crv_out = None  # 使用 None 代替空列表
rail_top_out = None
section_crv_out = None

# =========================================================
# 请注意在 Grasshopper 中设置输入的 Type Hint:
# x, y, z, a, b 必须设置为 float (浮点数)。
# c 必须设置为 Boolean (布尔值)。
# =========================================================

# ---------------------------------------------------------
# 输入映射（根据您的 Slider 顺序）：
# x=H (20), y=L (100), z=W (50), a=R (10), b=T (0.25)
# ---------------------------------------------------------
if c: # 使用 c 作为开关 (Boolean n)
    
    # --- 1. 定义基本参数 ---
    H = x    # 高度 (max_height)
    L = y    # 长度 (base_length)
    W = z    # 宽度 (base_width)
    R = a    # 圆角半径 (radius)
    T = b    # 侧面收拢因子 (taper_factor, 0-1)
    
    # --- 2. 创建底部圆角轮廓 (Base Curve) ---
    # 这部分保持不变，用于底座轮廓。
    
    pts = []
    pts.append(rg.Point3d(L/2, W/2, 0))
    pts.append(rg.Point3d(-L/2, W/2, 0))
    pts.append(rg.Point3d(-L/2, -W/2, 0))
    pts.append(rg.Point3d(L/2, -W/2, 0))
    
    base_polyline = rg.Polyline(pts)
    base_crv = base_polyline.ToNurbsCurve()
    
    base_crv_rounded_array = base_crv.CreateFilletedCurves(rg.Plane.WorldXY, R, 0.001, 0.001)
    
    if base_crv_rounded_array and base_crv_rounded_array.Length > 0:
        base_crv_out = base_crv_rounded_array[0] # 输出圆角底座曲线
    
        # --- 3. 创建顶部轨道曲线 (Rail Top / 脊线) ---
        
        # 轨道沿着 X 轴 (长度) 方向，Y=0, Z=高度 (XZ平面)
        p_start = rg.Point3d(-L/2, 0, 0)
        p_end = rg.Point3d(L/2, 0, 0)
        
        # 峰值点 (最高点)
        peak_x = -L/2 + L*0.6 # 位于后部偏前
        p_peak = rg.Point3d(peak_x, 0, H) 
        
        # 顶部脊线曲线控制点 (模拟拱形)
        profile_pts = [p_start, 
                       rg.Point3d(-L/2 + L*0.3, 0, H*0.5), # 抬升点 1
                       p_peak, 
                       rg.Point3d(L/2 - L*0.1, 0, H*0.2),  # 抬升点 2
                       p_end]
                       
        rail_top_out = rg.NurbsCurve.Create(False, 3, profile_pts) 
        
        # --- 4. 创建截面曲线 (Section Curve) ---
        
        # 截面必须在 YZ 平面上创建 (X=0)，垂直于轨道。
        
        # 计算收缩宽度
        side_width_tapered = W/2 * (1.0 - T) 
        side_width_base = W/2 
        side_height = H * 0.4 # 收腰点的高度
        
        # 截面形状的控制点 (位于 X=0 平面)
        sec_pts_final = []
        
        # 点 1: 左侧底部 (Y 轴对应宽度，Z 轴对应高度)
        sec_pts_final.append(rg.Point3d(0, -side_width_base, 0)) 
        
        # 点 2: 左侧腰部收缩点
        sec_pts_final.append(rg.Point3d(0, -side_width_tapered, side_height))
        
        # 点 3: 顶部顶点 (H) - 确保中心点在 (0, 0, H)
        sec_pts_final.append(rg.Point3d(0, 0, H)) 
        
        # 点 4: 右侧腰部收缩点
        sec_pts_final.append(rg.Point3d(0, side_width_tapered, side_height))
        
        # 点 5: 右侧底部
        sec_pts_final.append(rg.Point3d(0, side_width_base, 0)) 
        
        section_crv_out = rg.NurbsCurve.Create(False, 3, sec_pts_final)
        
    else:
        # 如果圆角失败或 c 为 False，输出 None
        base_crv_out = None
        rail_top_out = None
        section_crv_out = None

# 将结果分配给 Grasshopper 输出
a = base_crv_out
b = rail_top_out
c = section_crv_out
# ---------- end python_3_script ----------
boundary_surfaces = BoundarySurfaces(Edges=surface)
number = Number(0.5)
expression = Expression(y=number_slider, Expression="y/2")
evaluate_length = EvaluateLength(Curve=python_3_script.a, Length=number, Normalized=Toggle(True))  # -> Point, Tangent, Parameter
sweep1 = Sweep1(Rail=flatten(python_3_script.b), Sections=flatten(python_3_script.c), Miter=1)
expression_2 = Expression(y=number_slider, Expression="-(y/2)")
merge = Merge(Data1=boundary_surfaces)
brep_join = BrepJoin(Breps=[boundary_surfaces, merge, sweep1])  # -> Breps, Closed
deconstruct_brep = DeconstructBrep(Brep=brep_join.Breps)  # -> Faces, Edges, Vertices
deconstruct = Deconstruct(Point=deconstruct_brep.Vertices)  # -> XComponent, YComponent, ZComponent
construct_point = ConstructPoint(XCoordinate=deconstruct.XComponent, YCoordinate=[expression, deconstruct.YComponent], ZCoordinate=deconstruct.ZComponent)  # -> flatten(Point)
construct_point_2 = ConstructPoint(
    XCoordinate=deconstruct.XComponent,
    YCoordinate=[expression_2, deconstruct.YComponent],
    ZCoordinate=deconstruct.ZComponent)  # -> flatten(Point)
merge_2 = Merge(Data1=construct_point_2, Data2=construct_point)
interpolate = Interpolate(Vertices=merge_2, Degree=3, Periodic=False, KnotStyle=1)  # -> Curve, Length, Domain
