# Grasshopper definition 渐变开洞.gh (Grasshopper 1.0.7)
# plug-ins: LunchBox, Bifocals

srf = Surface(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)
srf_2 = Surface(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)
srf_3 = Surface(srf)
srf_4 = Surface(srf_2)
grid = GridStructure(Surface=srf_3, UDivisions=Slider(30, range=0..100), VDivisions=Slider(20, range=0..100))  # -> StructureLines, StructureNodes
grid_2 = GridStructure(Surface=srf_4, UDivisions=Slider(30, range=0..100), VDivisions=Slider(20, range=0..100))  # -> StructureLines, StructureNodes
srfsplit = SurfaceSplit(Surface=srf_3, Curves=grid.StructureLines)
srfsplit_2 = SurfaceSplit(Surface=srf_4, Curves=grid_2.StructureLines)
area = Area(Geometry=srfsplit)  # -> Area, Centroid
area_2 = Area(Geometry=srfsplit_2)  # -> Area, Centroid
geo = Geometry(<curve referenced from the Rhino model>)
geo_2 = Geometry(<curve referenced from the Rhino model>)
pull = PullPoint(Point=area.Centroid, Geometry=geo, ClosestOnly=True)  # -> ClosestPoint, Distance
pull_2 = PullPoint(Point=area_2.Centroid, Geometry=geo_2, ClosestOnly=True)  # -> ClosestPoint, Distance
sort = SortList(Keys=pull_2.Distance, ValuesA=srfsplit_2)  # -> Keys, reverse(ValuesA)
lng = ListLength(List=pull.Distance)
jitter = Jitter(List=srfsplit, Jitter="1", Seed=2)  # -> Values, Indices
lng_2 = ListLength(List=sort.ValuesA)
multiplication = Multiplication(A=lng, B=Slider(0.2, range=0..1))
multiplication_2 = Multiplication(A=lng_2, B=Slider(0.29, range=0..1))
series = Series(Start=0, Step=1, Count=multiplication)
series_2 = Series(Start=0, Step=1, Count=multiplication_2)
jitter_2 = Jitter(List=sort.ValuesA, Jitter=Slider(0.29, range=0..1), Seed=2)  # -> Values, Indices
cull_i = CullIndex(List=jitter.Values, Indices=series, Wrap=True)
cull_i_2 = CullIndex(List=jitter_2.Values, Indices=series_2, Wrap=True)
lng_3 = ListLength(List=cull_i_2)
area_3 = Area(Geometry=cull_i)  # -> Area, Centroid
subtraction = Subtraction(A=lng_3, B="1")
lng_4 = ListLength(List=cull_i)
pull_3 = PullPoint(Point=area_3.Centroid, Geometry=geo, ClosestOnly=True)  # -> ClosestPoint, Distance
range = Range(Domain=Domain(0, 1), Steps=subtraction)
sort_2 = SortList(Keys=pull_3.Distance, ValuesA=cull_i)  # -> Keys, ValuesA
subtraction_2 = Subtraction(A=lng_4, B="1")
gradient = Gradient(LowerLimit=0, UpperLimit=1, Parameter=range, stops=[0.361: RGB(255, 130, 160), 0.85: RGB(220, 0, 40)])
range_2 = Range(Domain=Domain(0, 1), Steps=subtraction_2)
jitter_3 = Jitter(List=sort_2.ValuesA, Jitter=Slider(0.1, range=0..1), Seed=2)  # -> Values, Indices
gradient_2 = Gradient(LowerLimit=0, UpperLimit=1, Parameter=range_2, stops=[0.361: RGB(255, 130, 160), 0.85: RGB(220, 0, 40)])
jitter_4 = Jitter(List=gradient, Jitter=Slider(1, range=0..1), Seed=2)  # -> Values, Indices
preview = CustomPreview(Geometry=cull_i_2, Material=jitter_4.Values)
preview_2 = CustomPreview(Geometry=jitter_3.Values, Material=gradient_2)  # disabled
