# Grasshopper definition 织物打印6.gh (Grasshopper 1.0.8)
# plug-ins: LunchBox, Noise 4D

rectangle = Rectangle(Plane=PlaneXY(0, 0, 0), XSize="400", YSize="300", Radius=0)  # -> Rectangle, Length
skewed_quads = SkewedQuads(Surface=rectangle.Rectangle, UDivisions="80", VDivisions="60", TParameter=0)  # -> FullPanels, EdgePanels
boundary_surfaces = BoundarySurfaces(Edges=rectangle.Rectangle)
area = Area(Geometry=skewed_quads.FullPanels)  # -> Area, Centroid
mesh_surface = MeshSurface(Surface=boundary_surfaces, UCount="80", VCount="60", Overhang=True, Equalize=False)
simplexnoise = SimplexNoise(Values=area.Centroid, Time="25", Scale="0.005")
face_boundaries = FaceBoundaries(Mesh=mesh_surface)
face_normals = FaceNormals(Mesh=mesh_surface)  # -> Centers, Normals
multiplication = Multiplication(A=simplexnoise, B="18")
sine = Sine(Value=multiplication)
simplexnoise_2 = SimplexNoise(Values=face_normals.Centers, Time="25", Scale="0.005")
multiplication_2 = Multiplication(A=simplexnoise_2, B="18")
construct_domain = ConstructDomain(DomainStart=-1, DomainEnd=1)
construct_domain_2 = ConstructDomain(DomainStart=-1, DomainEnd=1)
sine_2 = Sine(Value=multiplication_2)
construct_domain_3 = ConstructDomain(DomainStart="0.3", DomainEnd="1")
construct_domain_4 = ConstructDomain(DomainStart="1", DomainEnd="10")
remap_numbers = RemapNumbers(Value=sine_2, Source=construct_domain, Target=Domain(0, 1))  # -> Mapped, Clipped
remap_numbers_2 = RemapNumbers(Value=sine, Source=construct_domain_2, Target=construct_domain_3)  # -> Mapped, Clipped
remap_numbers_3 = RemapNumbers(Value=sine, Source=construct_domain_2, Target=construct_domain_4)  # -> Mapped, Clipped
gradient = Gradient(LowerLimit=0, UpperLimit=1, Parameter=remap_numbers.Mapped, stops=[0: RGB(255, 0, 128), 1: RGB(0, 234, 255)])
scale = Scale(Geometry=skewed_quads.FullPanels, Center=area.Centroid, Factor=remap_numbers_2.Mapped)  # -> Geometry, Transform
brep_edges = BrepEdges(Brep=scale.Geometry)  # -> Naked, Interior, NonManifold
join_curves = JoinCurves(Curves=brep_edges.Naked, Preserve=False)  # -> flatten(Curves)
mesh_spray = MeshSpray(Mesh=mesh_surface, Points=face_normals.Centers, Colours=gradient, SprayMode=11)
unit_z = UnitZ(Factor=remap_numbers_3.Mapped)
move = Move(Geometry=join_curves, Motion=unit_z)  # -> Geometry, Transform
scale_nu = ScaleNU(Geometry=move.Geometry, Plane=area.Centroid, ScaleX="0.1", ScaleY="0.1", ScaleZ=1)  # -> Geometry, Transform
merge = Merge(Data1=simplify(graft(join_curves)), Data2=simplify(graft(scale_nu.Geometry)))
loft = Loft(Curves=merge, Options={Adjust=False, Closed=False, LoftEnds=0, LoftSimp=0, LoftType=0, Rebuild=10, Refit=0.01})
cap_holes = CapHoles(Brep=loft)
