# Grasshopper definition 音响洞.gh (Grasshopper 1.0.7)
# plug-ins: Human

number_slider = Slider(25, range=0..100)
dom = ConstructDomain(DomainStart=expr("-x/2", number_slider), DomainEnd=expr("x/2", number_slider))
rectangle = Rectangle(Plane=PlaneXY(0, 0, 0), XSize=dom, YSize=dom, Radius=0)  # -> Rectangle, Length
cir = Circle(Plane=PlaneXY(0, 0, 0), Radius=expr("x/2", number_slider))
number_slider_2 = Slider(20, range=0..50)
previewlw = CustomPreviewLineweights(Geometry=cir, Shader=ColourSwatch(SwatchColor=RGB(0, 0, 0)), Thickness=Slider(3, range=0..10), Absolute=False)
range = Range(Domain=Domain(0, 1), Steps=number_slider_2)
cull_i = CullIndex(List=range, Indices="0", Wrap=True)
multiplication = Multiplication(A=number_slider_2, B=Slider(4, range=0..10))
graph = GraphMapper(
    cull_i,
    x0=0,
    x1=1,
    y0=0,
    y1=1,
    container_name="Bezier",
    cpx=[0, 0.4745355248, 0.8024915457, 1],
    cpy=[0, 0.1303489804, 0.5161797404, 1])
graph_2 = GraphMapper(
    cull_i,
    x0=0,
    x1=1,
    y0=0,
    y1=1,
    container_name="Bezier",
    cpx=[0, 0.5562301874, 0.8359578252, 1],
    cpy=[0, 0, 0.6447036266, 1])
multiplication_2 = Multiplication(A=cull_i, B=Slider(1.5, range=0..3))
multiplication_3 = Multiplication(A=graph, B=Slider(10, range=0..20))
number_slider_3 = Slider(0.05, range=0..0.1)
cir_2 = Circle(Plane=PlaneXY(0, 0, 0), Radius=multiplication_3)
multiplication_4 = Multiplication(A=graph_2, B=number_slider_3)
seam = Seam(Curve=reparameterize(cir_2), Seam=multiplication_2)
division = Division(A=multiplication_4, B=Slider(7, range=0..10))
divide = DivideCurve(Curve=seam, Count=multiplication, Kinks=False)  # -> Points, Tangents, Parameters
series = Series(Start=number_slider_3, Step=division, Count=expr("x/2", multiplication))
dup = DuplicateData(Data=series, Number=2, Order=True)  # -> reverse(Data)
cir_3 = Circle(Plane=divide.Points, Radius=dup)
srf = Surface(cir_3)
preview = CustomPreview(Geometry=srf, Material=ColourSwatch(SwatchColor=RGB(255, 255, 255)))
